# Grasshopper definition nakagincapsuletower.gh (Grasshopper 1.0.7)
# plug-ins: Semio, Human

list = ValueList({"Back", "Side"}, selected="Side")
list_2 = ValueList({"Front", "Side"}, selected="Side")
parameter = ConstructParameter(Name="Entrance", Value=list)
parameter_2 = ConstructParameter(Name="Window", Value=list_2)
parameter_3 = ConstructParameter(Name="Mirror", Value=Toggle(True))
number_slider = Slider(10, range=0..100)
list_3 = ValueList({"Front", "Side"}, selected="Front")
parameter_4 = ConstructParameter(Name="Gap", Value=Slider(0, range=0..100))
parameter_5 = ConstructParameter(Name="Length", Value=Slider(420, range=0..1000))
parameter_6 = ConstructParameter(Name="Width", Value=Slider(270, range=0..1000))
parameter_7 = ConstructParameter(Name="Height", Value=Slider(275, range=0..1000))
parameter_8 = ConstructParameter(Name="Mirror", Value=Toggle(False))
parameter_9 = ConstructParameter(Name="Window", Value=list_3)
bias = Parameter(parameter_4)
panel = Panel("C:\Git\Studium\PhD\semio\examples\capsuletower")
common = Parameter()
parameter_10 = ConstructParameter(Name="Length", Value=Slider(420, range=0..1000))
common_2 = Parameter(common)
merge = Merge(Data1=common_2, Data2=parameter_2, Data3=parameter_3)
merge_2 = Merge(Data1=common_2)
merge_3 = Merge(Data1=common_2, Data2=parameter, Data3=parameter_3)
merge_4 = Merge(Data1=common_2, Data2=parameter)
capsules = Integer(Slider(10, range=0..10))
concat = Concatenate(FragmentA=panel, FragmentB="\", FragmentC="base.gh")
concat_2 = Concatenate(FragmentA=panel, FragmentB="\", FragmentC="shaft.gh")
concat_3 = Concatenate(FragmentA=panel, FragmentB="\", FragmentC="capital.gh")
concat_4 = Concatenate(FragmentA=panel, FragmentB="\", FragmentC="capsule.gh")
uri = Text(concat_4)
plan = ConstructPlan(Uri=uri, Parameters=merge_2)  # -> Plan, Hash
plan_2 = ConstructPlan(Uri=uri, Parameters=merge)  # -> Plan, Hash
plan_3 = ConstructPlan(Uri=uri, Parameters=merge_3)  # -> Plan, Hash
plan_4 = ConstructPlan(Uri=uri, Parameters=merge_4)  # -> Plan, Hash
e_side_m_true = Plan(plan_3.Plan)
normal = Plan(plan.Plan)
e_side = Plan(plan_4.Plan)
w_side_m_true = Plan(plan_2.Plan)
dup = DuplicateData(Data=e_side, Number="3", Order=True)
dup_2 = DuplicateData(Data=normal, Number="2", Order=True)
trim = TrimTree(Tree=dup, Depth=1)
trim_2 = TrimTree(Tree=dup_2, Depth=1)
number_slider_2 = Slider(-5, range=-1000..1000)
merge_5 = Merge(Data1=normal, Data2=trim, Data3=trim_2, Data4=e_side, Data5=normal, Data6=e_side, Data7=normal, Data8=normal)
parameter_11 = ConstructParameter(Name="Floors", Value="11")

# ---- group: primary shaft
list_4 = ValueList({"Front", "Right", "Bottom", "Left"}, selected="Right")
parameter_12 = ConstructParameter(Name="DoorOffset", Value=Slider(140, range=0..1000))
parameter_13 = ConstructParameter(Name="Bridge", Value=list_4)
num = Number("1")
num_2 = Number("1")
num_3 = Number("1")
num_4 = Number("2")
parameter_14 = ConstructParameter(Name="Floor", Value=num)
parameter_15 = ConstructParameter(Name="SplitLevel", Value=num_3)
parameter_16 = ConstructParameter(Name="SplitLevel", Value=num_4)
plan_5 = ConstructPlan(Uri=concat_2, Parameters=[parameter_13, parameter_12, parameter_11])  # -> Plan, Hash
panel_2 = Panel("Door")
parameter_17 = ConstructParameter(Name=panel_2, Value=num_2)
sobject = ConstructSobject(Plan=plan_5.Plan)
link = ConstructLink(Ports="Bottom")
link_2 = ConstructLink(Ports="Top")
link_3 = ConstructLink(Ports=panel_2, Bias=parameter_14)
link_4 = ConstructLink(Ports=panel_2, Bias=[parameter_14, parameter_17])
link_5 = ConstructLink(Ports=panel_2, Bias=[parameter_14, parameter_15])
link_6 = ConstructLink(Ports=panel_2, Bias=[parameter_14, parameter_16])
connectable = ConstructConnectable(Sobject=sobject, Link=link)
connectable_2 = ConstructConnectable(Sobject=sobject, Link=link_2)
connectable_3 = ConstructConnectable(Sobject=sobject, Link=link_3)
connectable_4 = ConstructConnectable(Sobject=sobject, Link=link_4)
connectable_5 = ConstructConnectable(Sobject=sobject, Link=link_5)
connectable_6 = ConstructConnectable(Sobject=sobject, Link=link_6)

# ---- group: secondary shaft
list_5 = ValueList({"Front", "Right", "Bottom", "Left"}, selected="Left")
parameter_18 = ConstructParameter(Name="DoorOffset", Value=Slider(140, range=0..1000))
parameter_19 = ConstructParameter(Name="Bridge", Value=list_5)
parameter_20 = ConstructParameter(Name="Floors", Value="9")
plan_6 = ConstructPlan(Uri=concat_2, Parameters=[parameter_19, parameter_18, parameter_20])  # -> Plan, Hash
sobject_2 = ConstructSobject(Plan=plan_6.Plan)
connectable_7 = ConstructConnectable(Sobject=sobject_2, Link=link)
connectable_8 = ConstructConnectable(Sobject=sobject_2, Link=link_3)
connectable_9 = ConstructConnectable(Sobject=sobject_2, Link=link_2)

# ---- group: primary shaft captial
xy = XYPlane(Origin=Point(0, 0, 0))
prot = RotatePlane(Plane=xy, Angle=degrees("-90"))
plan_7 = ConstructPlan(Uri=concat_3)  # -> Plan, Hash
sobject_3 = ConstructSobject(Pose=prot, Plan=plan_7.Plan)
connectable_10 = ConstructConnectable(Sobject=sobject_3, Link=link)

# ----
concat_5 = Concatenate(FragmentA=panel, FragmentB="\", FragmentC="bouleenewtoncapsule.gh")
parameter_21 = ConstructParameter(Name="V", Value="0")

plan_8 = ConstructPlan(Uri=concat_3)  # -> Plan, Hash
sobject_4 = ConstructSobject(Pose=prot, Plan=plan_8.Plan)
connectable_11 = ConstructConnectable(Sobject=sobject_4, Link=link)

# ---- group: base
sobject_5 = ConstructSobject(Plan=concat)
link_7 = ConstructLink(Ports="Primary")
link_8 = ConstructLink(Ports="Secondary")
connectable_12 = ConstructConnectable(Sobject=sobject_5, Link=link_7)
connectable_13 = ConstructConnectable(Sobject=sobject_5, Link=link_8)

# ----
link_9 = ConstructLink(Ports=panel_2, Bias=bias)
link_10 = ConstructLink(Ports="Side", Bias=bias)
link_11 = ConstructLink(Bias=[parameter_21, bias])
cluster = Cluster(
    X=Slider(-400, range=-1000..1000),
    Y=Slider(10, range=-1000..1000),
    Z=0,
    yaw=Slider(0, range=-360..360),
    pitch=Slider(0, range=-360..360),
    roll=Slider(0, range=-360..360))
connection = ConstructConnection(Connecting=connectable_10, Connected=connectable_2)
connection_2 = ConstructConnection(Connecting=connectable_11, Connected=connectable_9)
connection_3 = ConstructConnection(Connecting=connectable_7, Connected=connectable_13)
run = Boolean(Toggle(False))
server = Text("http://localhost:2999")
connection_4 = ConstructConnection(Connecting=connectable, Connected=connectable_12)
merge_6 = Merge()
merge_7 = Merge(Data1=connection_3, Data2=connection_2)
previewplane = PreviewPlane(plane=merge_6, axis_length=Slider(200, range=0..1000))
number_slider_3 = Slider(100, range=0..1000)
layout = ConstructLayout(Sobjects=[sobject_5, sobject], Connections=connection_4, Assembly=sobject_5)
layout_design = LayoutDesign(Url=server, Layout=layout, Run=Toggle(False))
panel_3 = Panel("Simple")
design = ShowDesign(Design=layout_design, Concepts="Detailed")
swatch = ColourSwatch(SwatchColor=RGB(255, 255, 255))
genes = GenePool(Decimals=0, Maximum=10, Minimum=0, Value=[8, 8])
genes_2 = GenePool(Decimals=0, Maximum=10, Minimum=0, Value=[8, 8])
swatch_2 = ColourSwatch(SwatchColor=RGB(191, 216, 255))
swatch_3 = ColourSwatch(SwatchColor=RGB(75, 85, 100))
swatch_4 = ColourSwatch(SwatchColor=RGB(37, 42, 50))
sobject_6 = ConstructSobject(Plan=concat)
sobject_7 = ConstructSobject(Plan=concat)
swatch_5 = ColourSwatch(SwatchColor=RGB(235, 52, 79))
swatch_6 = ColourSwatch(SwatchColor=RGB(0, 166, 157))
swatch_7 = ColourSwatch(SwatchColor=RGB(240, 117, 24))
sobject_8 = ConstructSobject(Plan=concat_2)
connectable_14 = ConstructConnectable(Sobject=sobject_7)
connectable_15 = ConstructConnectable(Sobject=sobject_6)
merge_8 = Merge(Data1=sobject_7, Data2=sobject_6)
normallinethickness = Number(Slider(2, range=0..10))
explosionlinepattern = Number(genes)
hiddenlinethickness = Number(Slider(1, range=0..1))
hiddenlinepattern = Number(genes_2)
normallinecolor = Colour()
button = Button(ExpressionNormal="True", ExpressionPressed="False")
layout_2 = ConstructLayout(Sobjects=sobject_8, Assembly=sobject_8)
saveviewports = Boolean(Button())
scalefactor = Number(Slider(1, range=0..10))
transparency = Number(Slider(0, range=0..1))
layout_3 = ConstructLayout(Sobjects=sobject_7, Assembly=sobject_7)
pt = ConstructPoint(
    XCoordinate=Slider(2000, range=0..10000),
    YCoordinate=Slider(-3000, range=-10000..-3000),
    ZCoordinate=Slider(2000, range=0..10000))
vec = VectorXYZ(XComponent=Slider(2, range=-10..10), YComponent=Slider(-2.9, range=-10..10), ZComponent=Slider(-1, range=-10..10))  # -> Vector, Length
link_12 = ConstructLink()
Z = UnitZ(Factor=1)
layout_design_2 = LayoutDesign(Url=server, Layout=layout_2, Run=Toggle(True))
layout_design_3 = LayoutDesign(Url=server, Layout=layout_3, Run=Toggle(True))
rhinovp = RhinoViewport(N="Diagram", P="0", WD=Domain2(u=0..1000, v=0..1000), T="False", A=button)  # -> F; inputs P: Int32, T: Boolean, A: Boolean
#   port P: 0 = None 1 = Top 2 = Bottom 3 = Left 4 = Right 5 = Front 6 = Back 7 = Perspective 8 = TwoPointPerspective
# ---------- rhinovp: Python ----------
#Component Information
#--------------------------------------------------------------------------------------------
if ghenv.Component.RunCount<2:
    #General
    #--------------------------------------------------------------------------------------------
    __author__ = "Ueli Saluz"
    __version__ = "2023.04.05"
    
    ghenv.Component.Name = "RhinoViewport"
    ghenv.Component.NickName = "RhinoVP"
    ghenv.Component.Description = "Launches or closes a Rhino viewport."
    ghenv.Component.Message = "VER 1.3"
    ghenv.Component.Category = "Display"
    ghenv.Component.SubCategory = "Camera"
    
     #Inputs
    #--------------------------------------------------------------------------------------------
    inputIndex=0
    
    ghenv.Component.Params.Input[inputIndex].Name = "Name"
    ghenv.Component.Params.Input[inputIndex].NickName = "N"
    ghenv.Component.Params.Input[inputIndex].Description = "Name of the viewport"
    ghenv.Component.Params.Input[inputIndex].Optional = False
    inputIndex+=1
    
    ghenv.Component.Params.Input[inputIndex].Name = "ViewportProjection"
    ghenv.Component.Params.Input[inputIndex].NickName = "P"
    ghenv.Component.Params.Input[inputIndex].Description = "0  = None \n1 = Top \n2 = Bottom \n3 = Left \n4 = Right \n5 = Front\n6 = Back\n7 = Perspective\n8 = TwoPointPerspective"
    ghenv.Component.Params.Input[inputIndex].Optional = False
    inputIndex+=1
    
    ghenv.Component.Params.Input[inputIndex].Name = "WindowDomain"
    ghenv.Component.Params.Input[inputIndex].NickName = "WD"
    ghenv.Component.Params.Input[inputIndex].Description = "The domain of the window. The U domain corresponds to X and the V domain to Y."
    ghenv.Component.Params.Input[inputIndex].Optional = False
    inputIndex+=1
    
    ghenv.Component.Params.Input[inputIndex].Name = "TitleVisible"
    ghenv.Component.Params.Input[inputIndex].NickName = "T"
    ghenv.Component.Params.Input[inputIndex].Description = "True if Rhino view title should be visible."
    ghenv.Component.Params.Input[inputIndex].Optional = True
    inputIndex+=1
    
    ghenv.Component.Params.Input[inputIndex].Name = "WallPaperPath"
    ghenv.Component.Params.Input[inputIndex].NickName = "WP"
    ghenv.Component.Params.Input[inputIndex].Description = "The domain of the window. The U domain corresponds to X and the V domain to Y."
    ghenv.Component.Params.Input[inputIndex].Optional = True
    inputIndex+=1
    
    ghenv.Component.Params.Input[inputIndex].Name = "ScaleFactor"
    ghenv.Component.Params.Input[inputIndex].NickName = "S"
    ghenv.Component.Params.Input[inputIndex].Description = "A scale factor that is applied on the window domains."
    ghenv.Component.Params.Input[inputIndex].Optional = True
    inputIndex+=1
    
    ghenv.Component.Params.Input[inputIndex].Name = "Active"
    ghenv.Component.Params.Input[inputIndex].NickName = "A"
    ghenv.Component.Params.Input[inputIndex].Description = "Activate or deactivate the window."
    ghenv.Component.Params.Input[inputIndex].Optional = False
    inputIndex+=1
    
    #Outputs
    #--------------------------------------------------------------------------------------------
    outputIndex=0
    
    ghenv.Component.Params.Output[outputIndex].Name = "Finished"
    ghenv.Component.Params.Output[outputIndex].NickName = "F"
    ghenv.Component.Params.Output[outputIndex].Description = "Sends True when finished. Just to trigger other depending components."
    outputIndex+=1


#Imports
#--------------------------------------------------------------------------------------------
from System import Object, Enum
from Grasshopper import DataTree
import System as sy
import Rhino as rc
import scriptcontext as sc
import clr
import System.Windows.Forms.Control

#Solver - Run with trees to enhance performance drastically
#--------------------------------------------------------------------------------------------
if __name__ == "__main__":
    
    vp = rc.RhinoDoc.ActiveDoc.Views.Find(N, False)
    if A:
        scaleFacor = 1 if S is None else S
        if vp:
            vp.Close()
        
        #The width is 16 pixel and height is 39 too little. Additionally the windows start 8 pixel shifted to the left. Why? I don't know.
        windowRectangle = sy.Drawing.Rectangle(WD.U0*scaleFacor-8,WD.V0*scaleFacor,WD.U.Length*scaleFacor+16,WD.V.Length*scaleFacor+39)
        newView = rc.RhinoDoc.ActiveDoc.Views.Add(N,Enum.ToObject(rc.Display.DefinedViewportProjection, P),windowRectangle,True)
        #newView seems to not set the name properly
        newView.MainViewport.Name = N
        if T==False:
            newView.TitleVisible = False
        viewport = newView.ActiveViewport
        if WP is not None:
            viewport.SetWallpaper(WP,False)
        
        viewport.ConstructionAxesVisible = False
        viewport.ConstructionGridVisible = False
        viewport.WorldAxesVisible = False
        
    else:
        if vp:
            vp.Close()
    F = True
# ---------- end rhinovp ----------
setview = SetView(N="Diagram", P="0", L=pt, D=vec.Vector, Up=Z, R=Button(ExpressionNormal="True", ExpressionPressed="False"))  # -> F; inputs P: Int32, L: Point3d, D: Vector3d, Up: Vector3d, R: Boolean
#   port P: 0 = Parallel view 1 = Perspective view
# ---------- setview: Python ----------
#Component Information
#--------------------------------------------------------------------------------------------
if ghenv.Component.RunCount<2:
    #General
    #--------------------------------------------------------------------------------------------
    __author__ = "Ueli Saluz"
    __version__ = "2022.05.22"
    
    ghenv.Component.Name = "SetView"
    ghenv.Component.NickName = "SetView"
    ghenv.Component.Description = "Set a camera view and projection."
    ghenv.Component.Message = "VER 1.1"
    ghenv.Component.Category = "Display"
    ghenv.Component.SubCategory = "Camera"
    
     #Inputs
    #--------------------------------------------------------------------------------------------
    inputIndex=0
    
    ghenv.Component.Params.Input[inputIndex].Name = "Name"
    ghenv.Component.Params.Input[inputIndex].NickName = "N"
    ghenv.Component.Params.Input[inputIndex].Description = "Name of the viewport"
    ghenv.Component.Params.Input[inputIndex].Optional = True
    inputIndex+=1
    
    ghenv.Component.Params.Input[inputIndex].Name = "Projection"
    ghenv.Component.Params.Input[inputIndex].NickName = "P"
    ghenv.Component.Params.Input[inputIndex].Description = "0 = Parallel view\n"+\
                                                           "1 = Perspective view"
    ghenv.Component.Params.Input[inputIndex].Optional = True
    inputIndex+=1
    
    
    ghenv.Component.Params.Input[inputIndex].Name = "CameraLocation"
    ghenv.Component.Params.Input[inputIndex].NickName = "L"
    ghenv.Component.Params.Input[inputIndex].Description = "Location of the camera."
    ghenv.Component.Params.Input[inputIndex].Optional = True
    inputIndex+=1
    
    ghenv.Component.Params.Input[inputIndex].Name = "CameraDirection"
    ghenv.Component.Params.Input[inputIndex].NickName = "D"
    ghenv.Component.Params.Input[inputIndex].Description = "Direction of the camera."
    ghenv.Component.Params.Input[inputIndex].Optional = True
    inputIndex+=1
    
    ghenv.Component.Params.Input[inputIndex].Name = "CameraUp"
    ghenv.Component.Params.Input[inputIndex].NickName = "Up"
    ghenv.Component.Params.Input[inputIndex].Description = "Up vector of the camera."
    ghenv.Component.Params.Input[inputIndex].Optional = True
    inputIndex+=1
    
    ghenv.Component.Params.Input[inputIndex].Name = "LensLength"
    ghenv.Component.Params.Input[inputIndex].NickName = "LL"
    ghenv.Component.Params.Input[inputIndex].Description = "Lens length of the camera. Only relevant if projection is perspective."
    ghenv.Component.Params.Input[inputIndex].Optional = True
    inputIndex+=1
    
    ghenv.Component.Params.Input[inputIndex].Name = "Run"
    ghenv.Component.Params.Input[inputIndex].NickName = "R"
    ghenv.Component.Params.Input[inputIndex].Description = "Zoom to the given bounding box."
    ghenv.Component.Params.Input[inputIndex].Optional = False
    inputIndex+=1
    
    #Outputs
    #--------------------------------------------------------------------------------------------
    outputIndex=0
    
    ghenv.Component.Params.Output[outputIndex].Name = "Finished"
    ghenv.Component.Params.Output[outputIndex].NickName = "F"
    ghenv.Component.Params.Output[outputIndex].Description = "Sends True when finished. Just to trigger other depending components."
    outputIndex+=1
    


#Imports
#--------------------------------------------------------------------------------------------
from Rhino import RhinoDoc
from Rhino.Geometry import Box

#Solver - Run with trees to enhance performance drastically
#--------------------------------------------------------------------------------------------
if __name__ == "__main__":
    
    if R:
        if N is not None:
            view = RhinoDoc.ActiveDoc.Views.Find(N, False)
        else:
            view = RhinoDoc.ActiveDoc.Views.ActiveView
        vp = view.ActiveViewport
        if P is not None:
            if (P==0):
                vp.ChangeToParallelProjection(True)
            else:
                vp.ChangeToPerspectiveProjection(True,LL)
        if L is not None:
            vp.SetCameraLocation(L,False)
        if D is not None:
            vp.SetCameraDirection(D,False)
        if Up is not None:
            vp.CameraUp = Up
    F = True
# ---------- end setview ----------
design_2 = ShowDesign(Design=layout_design_3, Concepts="Detailed")
number_slider_4 = Slider(5000, range=0..10000)
toggle = BooleanToggle(True)
number_slider_5 = Slider(1, range=-10..10)
number_slider_6 = Slider(1, range=-10..10)
m2d_rhino = Make2DRhinoView(Name="Diagram", Clip=True)
design_3 = ShowDesign(Design=layout_design_2)
pt_2 = ConstructPoint(XCoordinate=number_slider_4, YCoordinate=number_slider_4, ZCoordinate=0)
vec_2 = VectorXYZ(XComponent=0, YComponent=0, ZComponent=Slider(-1, range=-10..10))  # -> Vector, Length
Z_2 = UnitZ(Factor=1)
saveview = SaveViewportToFile(Run=saveviewports, ViewportName="Drawing", Render=False, FilePath="axonometry.png", ScaleFactor=scalefactor)
rhinovp_2 = RhinoViewport(N="Drawing", P="0", WD=Domain2(u=0..1000, v=0..1000), T="False", A=button)  # -> F; inputs P: Int32, T: Boolean, A: Boolean; same code as rhinovp
setview_2 = SetView(N="Drawing", P="0", L=pt_2, D=vec_2.Vector, Up=Z_2)  # -> F; inputs P: Int32, L: Point3d, D: Vector3d, Up: Vector3d, R: Boolean; same code as setview
merge_9 = Merge()
drawinghidden = Curve()
drawingvisible = Curve()
trim_3 = TrimTree(Depth=1)
dash = DashPattern(Curve=drawinghidden)  # -> Dashes, Gaps
dash_2 = DashPattern(Curve=trim_3)  # -> Dashes, Gaps
previewlw = CustomPreviewLineweights(
    Geometry=dash_2.Dashes,
    Shader={diffuse=RGB(255, 105, 180), emission=RGB(76, 32, 54), shine=0.5, specular=RGB(255, 255, 255), transparency=0},
    Absolute=False)
previewlw_2 = CustomPreviewLineweights(
    Geometry=drawingvisible,
    Shader={diffuse=RGB(255, 105, 180), emission=RGB(76, 32, 54), shine=0.5, specular=RGB(255, 255, 255), transparency=0},
    Absolute=False)
previewlw_3 = CustomPreviewLineweights(
    Geometry=dash.Dashes,
    Shader={diffuse=RGB(255, 105, 180), emission=RGB(76, 32, 54), shine=0.5, specular=RGB(255, 255, 255), transparency=0},
    Absolute=False)

xy_2 = XYPlane(Origin=Point(0, 0, 0))
prot_2 = RotatePlane(Plane=xy_2, Angle=degrees("180"))

prot_3 = RotatePlane(Plane=xy_2, Angle=degrees("90"))

dup_3 = DuplicateData(Data=normal, Number="11", Order=True)
trim_4 = TrimTree(Tree=dup_3, Depth=1)
topbottom = TopBottom(pl=trim_4, po=prot_2, pr=bias)  # -> so_2, C_2, first_2, last_2
link_13 = ConstructLink(Ports=panel_2, Bias=bias)
link_14 = ConstructLink(Ports="Side", Bias=bias)
connectable_16 = ConstructConnectable(Sobject=topbottom.first_2, Link=link_14)
connectable_17 = ConstructConnectable(Sobject=topbottom.first_2, Link=link_13)

dup_4 = DuplicateData(Data=e_side, Number="11", Order=True)

dup_5 = DuplicateData(Data=w_side_m_true, Number="10", Order=True)
trim_5 = TrimTree(Tree=dup_5, Depth=1)
parameter_22 = ConstructParameter(Name="V", Value="0")
topbottom_2 = TopBottom(pl=trim_5, po=prot_2, pr=bias)  # -> so_2, C_2, first_2, last_2
link_15 = ConstructLink(Ports="Side", Bias=[parameter_22, bias])
connectable_18 = ConstructConnectable(Sobject=topbottom_2.first_2, Link=link_15)

trim_6 = TrimTree(Tree=dup_4, Depth=1)
topbottom_3 = TopBottom(pl=trim_6, po=prot_2, pr=bias)  # -> so_2, C_2, first_2, last_2
topbottom_4 = TopBottom(pl=merge_5, po=prot_3)  # -> so_2, C_2, first_2, last_2
connectable_19 = ConstructConnectable(Sobject=topbottom_3.first_2, Link=link_9)
connectable_20 = ConstructConnectable(Sobject=topbottom_3.first_2, Link=link_10)
connectable_21 = ConstructConnectable(Sobject=topbottom_4.first_2, Link=link_11)
connection_5 = ConstructConnection(Connecting=connectable_21, Connected=connectable_20)

connection_6 = ConstructConnection(Connecting=connectable_18, Connected=connectable_16)
merge_10 = Merge(Data1=topbottom.so_2, Data2=topbottom_2.so_2)
merge_11 = Merge(Data1=topbottom.C_2, Data2=connection_6, Data3=topbottom_2.C_2)

connection_7 = ConstructConnection(Connecting=connectable_19, Connected=connectable_6)
connection_8 = ConstructConnection(Connecting=connectable_3, Connected=connectable_17)
merge_12 = Merge(Data1=topbottom_3.C_2, Data2=connection_5, Data3=topbottom_4.C_2)
merge_13 = Merge(Data1=topbottom_3.so_2, Data2=topbottom_4.so_2)
merge_14 = Merge(Data1=connection_8, Data2=connection, Data3=connection_7)
merge_15 = Merge(Data1=merge_10, Data2=merge_13)
merge_16 = Merge(Data1=sobject_5, Data2=sobject, Data3=sobject_3, Data4=sobject_4, Data5=sobject_2, Data6=merge_15)
merge_17 = Merge(Data1=merge_11, Data2=merge_12)
merge_18 = Merge(Data1=connection_4, Data2=merge_14, Data3=merge_7, Data4=merge_17)
layout_4 = ConstructLayout(Sobjects=merge_16, Connections=merge_18, Assembly=sobject_5)
layout_design_4 = LayoutDesign(Url=server, Layout=layout_4, Run=Toggle(True))
layout_5 = ConstructLayout(Sobjects=merge_15, Connections=merge_17, Assembly=topbottom.first_2)
layout_design_5 = LayoutDesign(Url=server, Layout=layout_5, Run=Toggle(True))
design_4 = ShowDesign(Design=layout_design_5, Concepts="Simple")
design_5 = ShowDesign(Design=layout_design_4, Concepts="Simple")
bbox = BoundingBox(Content=flatten(design_5), Plane=PlaneXY(0, 0, 0), UnionBox=True)  # -> Box, Box_2
wires = BrepWireframe(Brep=design_5, Density=-1)
dam = DataDam(DataA=bbox.Box, BufferDelay=10000000, BufferMode=0)
previewlw_4 = CustomPreviewLineweights(Geometry=wires, Shader=ColourSwatch(SwatchColor=RGB(0, 0, 0)), Thickness=normallinethickness, Absolute=False)
previewmat = CustomPreviewMaterials(Geometry=design_5, DiffuseColor=RGB(255, 255, 255), Transparency=transparency)
zoom2bb = ZoomToBoundingBox(N="Diagram", BB=dam, S=0, R=setview)  # -> F, SBB; inputs BB: Box, R: Boolean
# ---------- zoom2bb: Python ----------
#Component Information
#--------------------------------------------------------------------------------------------
if ghenv.Component.RunCount<2:
    #General
    #--------------------------------------------------------------------------------------------
    __author__ = "Ueli Saluz"
    __version__ = "2022.05.21"
    
    ghenv.Component.Name = "ZoomToBoundingBox"
    ghenv.Component.NickName = "Zoom2BB"
    ghenv.Component.Description = "Zoom the view of a Rhino viewport to a bounding box."
    ghenv.Component.Message = "VER 1.0"
    ghenv.Component.Category = "Display"
    ghenv.Component.SubCategory = "Camera"
    
     #Inputs
    #--------------------------------------------------------------------------------------------
    inputIndex=0
    
    ghenv.Component.Params.Input[inputIndex].Name = "Name"
    ghenv.Component.Params.Input[inputIndex].NickName = "N"
    ghenv.Component.Params.Input[inputIndex].Description = "Name of the viewport"
    ghenv.Component.Params.Input[inputIndex].Optional = False
    inputIndex+=1
    
    ghenv.Component.Params.Input[inputIndex].Name = "BoundingBox"
    ghenv.Component.Params.Input[inputIndex].NickName = "BB"
    ghenv.Component.Params.Input[inputIndex].Description = ""
    ghenv.Component.Params.Input[inputIndex].Optional = False
    inputIndex+=1
    
    ghenv.Component.Params.Input[inputIndex].Name = "ScaleFactor"
    ghenv.Component.Params.Input[inputIndex].NickName = "S"
    ghenv.Component.Params.Input[inputIndex].Description = "A factor for the extension of the bounding box." \
    +"0 means 0 extension, a positive number makes the bounding box larger a negative smaller. The amount is proportional to the length."
    ghenv.Component.Params.Input[inputIndex].Optional = False
    inputIndex+=1
   
    
    ghenv.Component.Params.Input[inputIndex].Name = "Run"
    ghenv.Component.Params.Input[inputIndex].NickName = "R"
    ghenv.Component.Params.Input[inputIndex].Description = "Zoom to the given bounding box."
    ghenv.Component.Params.Input[inputIndex].Optional = False
    inputIndex+=1
    
    #Outputs
    #--------------------------------------------------------------------------------------------
    outputIndex=0
    
    ghenv.Component.Params.Output[outputIndex].Name = "Finished"
    ghenv.Component.Params.Output[outputIndex].NickName = "F"
    ghenv.Component.Params.Output[outputIndex].Description = "Sends True when finished. Just to trigger other depending components."
    outputIndex+=1
    
    ghenv.Component.Params.Output[outputIndex].Name = "ScaledBoundingBox"
    ghenv.Component.Params.Output[outputIndex].NickName = "SBB"
    ghenv.Component.Params.Output[outputIndex].Description = "The scaled bounding box."
    outputIndex+=1


#Imports
#--------------------------------------------------------------------------------------------
from Rhino import RhinoDoc
from Rhino.Geometry import Box

#Solver - Run with trees to enhance performance drastically
#--------------------------------------------------------------------------------------------
if __name__ == "__main__":
    
    vp = RhinoDoc.ActiveDoc.Views.Find(N, False).ActiveViewport
    if R:
        box = BB
        bb = BB.BoundingBox
        bb.Inflate(S*box.X.Length,S*box.Y.Length,S*box.Z.Length)
        vp.ZoomBoundingBox(bb)
        SBB = bb
    F = True
# ---------- end zoom2bb ----------
make2d = Make2D(Geometry=design_5, View=m2d_rhino, TangentEdges=toggle, TangentSeams=toggle, AutoComputeMake2D=True)  # -> VisibleCurves, VisibleIndex, VisibleType, HiddenCurves, HiddenIndex, HiddenType
trim_7 = TrimTree(Tree=make2d.HiddenCurves, Depth=1)
trim_8 = TrimTree(Tree=make2d.VisibleCurves, Depth=1)
move = Move(Geometry=trim_7, Motion=pt_2)  # -> Geometry, Transform
move_2 = Move(Geometry=trim_8, Motion=pt_2)  # -> Geometry, Transform
bbox_2 = BoundingBox(Content=move_2.Geometry, Plane=PlaneXY(0, 0, 0), UnionBox=True)  # -> Box, Box_2
zoom2bb_2 = ZoomToBoundingBox(N="Drawing", BB=bbox_2.Box, S=0, R=setview_2)  # -> F, SBB; inputs BB: Box, R: Boolean; same code as zoom2bb

# ==== cluster Cluster
X = ClusterInput()
Y = ClusterInput()
Z = ClusterInput()
yaw = ClusterInput()
pitch = ClusterInput()
roll = ClusterInput()
yawpitchroll = NAME(yaw=yaw, pitch=pitch, roll=roll)  # -> t
# ---------- yawpitchroll: Python ----------
from Rhino.Geometry import Transform
from math import radians

t = Transform.RotationZYX(radians(yaw),radians(pitch),radians(roll))
# ---------- end yawpitchroll ----------
pt = ConstructPoint(XCoordinate=X, YCoordinate=Y, ZCoordinate=Z)
xy = XYPlane(Origin=Point(0, 0, 0))
transform = Transform(Geometry=xy, Transform=yawpitchroll)
pl_origin = PlaneOrigin(Base=transform, Origin=pt)
pln = Plane(pl_origin)
pln_2 = ClusterOutput(pln)

# ==== cluster PreviewPlane: Preview a plane with axis colors and naming.
axis_length = ClusterInput()
plane = ClusterInput()
axis_length_2 = Number(axis_length)
plane_2 = Plane(plane)
deplane = DeconstructPlane(Plane=plane_2)  # -> Origin, XAxis, YAxis, ZAxis
line = LineSDL(Start=deplane.Origin, Direction=deplane.YAxis, Length=axis_length_2)
line_2 = LineSDL(Start=deplane.Origin, Direction=deplane.XAxis, Length=axis_length_2)
line_3 = LineSDL(Start=deplane.Origin, Direction=deplane.ZAxis, Length=axis_length_2)
swatch = ColourSwatch(SwatchColor=RGB(235, 52, 79))
swatch_2 = ColourSwatch(SwatchColor=RGB(0, 166, 157))
swatch_3 = ColourSwatch(SwatchColor=RGB(240, 117, 24))
end = EndPoints(Curve=line_2)  # -> Start, End
end_2 = EndPoints(Curve=line)  # -> Start, End
end_3 = EndPoints(Curve=line_3)  # -> Start, End
tag = TextTag(Location=end.End, Text="X", Colour=swatch)
tag_2 = TextTag(Location=end_2.End, Text="Y", Colour=swatch_2)
tag_3 = TextTag(Location=end_3.End, Text="Z", Colour=swatch_3)
preview = CustomPreview(Geometry=line_2, Material=swatch)
preview_2 = CustomPreview(Geometry=line, Material=swatch_2)
preview_3 = CustomPreview(Geometry=line_3, Material=swatch_3)

# ==== cluster TopBottom
po = ClusterInput()
pl = ClusterInput()
pr = ClusterInput()
pr_2 = Parameter(pr)
po_2 = Pose(po)
pl_2 = Plan(pl)
sobject = ConstructSobject(Pose=po_2, Plan=pl_2)
link = ConstructLink(Ports="Top", Bias=pr_2)
link_2 = ConstructLink(Ports="Bottom", Bias=pr_2)
item = ListItem(List=sobject, Index=0, Wrap=True)  # -> Item1, Item
shift = ShiftList(List=sobject, Shift="-1", Wrap="False")
shift_2 = ShiftList(List=sobject, Shift=1, Wrap="False")
trim = TrimTree(Tree=shift_2, Depth=1)
trim_2 = TrimTree(Tree=shift, Depth=1)
connectable = ConstructConnectable(Sobject=trim_2, Link=link)
connectable_2 = ConstructConnectable(Sobject=trim, Link=link_2)
connection = ConstructConnection(Connecting=connectable_2, Connected=connectable)
C = Connection(connection)
first = Sobject(item.Item)
last = Sobject(item.Item1)
so = Sobject(sobject)
C_2 = ClusterOutput(C)
first_2 = ClusterOutput(first)
last_2 = ClusterOutput(last)
so_2 = ClusterOutput(so)
