# Grasshopper definition nakagin-capsule-tower-speckle.gh (Grasshopper 1.0.8)
# plug-ins: Speckle 2, semio

panel = Panel("Last Storey")
curdir = CurrentDirectory()  # -> PD, D, P, S
# ---------- curdir: Python ----------
# Component Information
# --------------------------------------------------------------------------------------------
if ghenv.Component.RunCount < 2:
    # General
    # --------------------------------------------------------------------------------------------
    __author__ = "Ueli Saluz"
    __version__ = "2024.07.26"

    ghenv.Component.Name = "CurrentDirectory"
    ghenv.Component.NickName = "CurDir"
    ghenv.Component.Description = "Current directory of the current grasshopper file."
    ghenv.Component.Message = "VER 1.1"
    ghenv.Component.Category = "Params"
    ghenv.Component.SubCategory = "Util"

    # Outputs
    # --------------------------------------------------------------------------------------------
    outputIndex = 0

    ghenv.Component.Params.Output[outputIndex].Name = "ParentDirectory"
    ghenv.Component.Params.Output[outputIndex].NickName = "PD"
    ghenv.Component.Params.Output[outputIndex].Description = "Parent directory of the current directory."
    outputIndex += 1

    ghenv.Component.Params.Output[outputIndex].Name = "Directory"
    ghenv.Component.Params.Output[outputIndex].NickName = "D"
    ghenv.Component.Params.Output[outputIndex].Description = "Directory of the current grasshopper file."
    outputIndex += 1

    ghenv.Component.Params.Output[outputIndex].Name = "Path"
    ghenv.Component.Params.Output[outputIndex].NickName = "P"
    ghenv.Component.Params.Output[outputIndex].Description = "Path of the current grasshopper file."
    outputIndex += 1

    ghenv.Component.Params.Output[outputIndex].Name = "Separator"
    ghenv.Component.Params.Output[outputIndex].NickName = "S"
    ghenv.Component.Params.Output[outputIndex].Description = "Separator of the current system."
    outputIndex += 1

# Imports
# --------------------------------------------------------------------------------------------
from os.path import dirname, abspath
from os import sep

# Solver - Run with trees to enhance performance drastically
# --------------------------------------------------------------------------------------------
if __name__ == "__main__":
    P = ghenv.Component.OnPingDocument().FilePath
    D = dirname(P)
    PD = dirname(D)
    S = sep
# ---------- end curdir ----------
mime = Mime({".stl": "model/stl", ".obj": "model/obj", ".glb": "model/gltf-binary", ".gltf": "model/gltf+json", ".3dm": "model/vnd.3dm", ".speckle": "model/vnd.speckle+json", ".png": "image/png", ".jpg": "image/jpeg", ".jpeg": "image/jpeg", ".svg": "image/svg+xml", ".pdf": "application/pdf", ".zip": "application/zip", ".json": "application/json", ".csv": "text/csv", ".txt": "text/plain"}, selected=".3dm")
mime_2 = Mime({".stl": "model/stl", ".obj": "model/obj", ".glb": "model/gltf-binary", ".gltf": "model/gltf+json", ".3dm": "model/vnd.3dm", ".speckle": "model/vnd.speckle+json", ".png": "image/png", ".jpg": "image/jpeg", ".jpeg": "image/jpeg", ".svg": "image/svg+xml", ".pdf": "application/pdf", ".zip": "application/zip", ".json": "application/json", ".csv": "text/csv", ".txt": "text/plain"}, selected=".speckle")
# TODO: Include layer nesting. Layer name doesn't include partents.
panel_2 = Panel("f8a0750f34")

# ---- group: Synchronize all representations with speckle NOTE: It can take quite long depending on the delay.
# 1. Export = True
# 2. Check "Send Automatically"
# 3. Reset
# 4. Uncheck "Send Automatically"
# 5. Export = False
# Restart
panel_3 = Panel("Cylindric Tambour")
variant = Slider(11, range=0..11)
upload_delay_s = Slider(4, range=0..10)
export = BooleanToggle(False)
reset = Button()
load = BooleanToggle(True)

# ----
kit = LoadKit(Directory=curdir.D, Run=load)  # -> Name, Description, Icon, Url, Homepage, Types, Formations
panel_4 = Panel(kit.Types)
trim = TrimTree(Tree=kit.Types, Depth=1)
trim_2 = TrimTree(Tree=kit.Formations, Depth=1)
typ = ModelType(Type=trim)  # -> Type, Name, Description, Icon, Variant, Unit, Representations, Ports, Qualities
for = ModelFormation(Formation=trim_2)  # -> Formation, Name, Description, Icon, Variant, Unit, Pieces, Connections, Qualities
tmatch = MatchText(Text=typ.Name, Pattern=panel_3, Case=True)
tmatch_2 = MatchText(Text=typ.Variant, Pattern="*", Case=True)
expression = Expression(x=for.Variant, y="Futuristic", Expression="x=y")
expression_2 = Expression(x=for.Name, y="Nakagin Capsule Tower", Expression="x=y")
expression_3 = Expression(x=for.Variant, Expression="x=y")
and = GateAnd(A=tmatch, B=tmatch_2)
cull = CullPattern(List=trim, CullPattern=and)  # -> graft(List)
and_2 = GateAnd(A=expression_2, B=expression_3)
and_3 = GateAnd(A=expression_2, B=expression)
cull_2 = CullPattern(List=trim_2, CullPattern=and_2)
cull_3 = CullPattern(List=trim_2, CullPattern=and_3)
typ_2 = ModelType(Type=cull)  # -> Type, Name, Description, Icon, Variant, Unit, Representations, Ports, Qualities
for_2 = ModelFormation(Formation=cull_2)  # -> Formation, Name, Description, Icon, Variant, Unit, Pieces, Connections, Qualities
trim_3 = TrimTree(Tree=typ_2.Representations, Depth=1)
scn = GetScene(FormationName=for_2.Name, FormationVariant=for_2.Variant, Run=False)
rep = ModelRepresentation(Representation=trim_3)  # -> Representation, Url, Mime, LoD, Tags
scn_2 = FilterScene(Scene=scn, Tags="volume")  # -> Representations, Planes, PiecesIds, ParentsPiecesIds
expression_4 = Expression(x=rep.Mime, y=mime, Expression="x=y")
expression_5 = Expression(x=rep.Mime, y=mime_2, Expression="x=y")
trim_4 = TrimTree(Tree=scn_2.Representations, Depth=1)
trim_5 = TrimTree(Tree=scn_2.Planes, Depth=1)
cull_4 = CullPattern(List=rep.Representation, CullPattern=expression_5)
cull_5 = CullPattern(List=rep.Representation, CullPattern=expression_4)
rep_2 = ModelRepresentation(Representation=trim_4)  # -> Representation, Url, LevelOfDetail, Tags, Tags_2
rep_3 = ModelRepresentation(Representation=cull_4)  # -> Representation, Url, Mime, LoD, Tags
rep_4 = ModelRepresentation(Representation=cull_5)  # -> Representation, Url, Mime, LoD, Tags
lng = ListLength(List=flatten(rep_4.Url))
expression_6 = Expression(x=lng, Expression="x-1")
panel_5 = Panel(expression_6)
tsort = SortText(Keys=rep_4.LoD, Values=rep_4.Url, Culture=127)  # -> Keys, Values
tsort_2 = SortText(Keys=rep_3.LoD, Values=rep_3.Url, Culture=127)  # -> Keys, Values
trim_6 = TrimTree(Tree=tsort_2.Values, Depth=1)
panel_6 = Panel(trim_6)
trim_7 = TrimTree(Tree=tsort.Values, Depth=1)  # -> graft(Tree)
panel_7 = Panel(trim_7)
concat = Concatenate(FragmentA=curdir.D, FragmentB=curdir.S, FragmentC=trim_7)
import = ImportContent(FilePath=concat, Import=load)  # -> ModelTransform, Objects, Layers, Linetypes, HatchPatterns, AnnotationStyles, Materials, BlockDefinitions
trim_8 = TrimTree(Tree=import.Objects, Depth=1)
trim_9 = TrimTree(Tree=import.Layers, Depth=1)
txt = Text(trim_9)
fragment = TextFragment(Text=txt, Start="14")
panel_8 = Panel(fragment)
object = ModelObject(Object=trim_8)  # -> Object, Geometry, Name, Layer, Visibility, Display, Drafting, Render
tstat = TreeStatistics(Tree=object.Geometry)  # -> Paths, Length, Count
item = ListItem(List=flatten(trim_7), Index=variant, Wrap=True)
panel_9 = Panel(item)
item_2 = ListItem(List=flatten(tstat.Paths), Index=variant, Wrap=True)
layer = ModelLayer(Layer=object.Layer)  # -> Layer, Name, Hidden, Locked, DisplayColour, Material, Linetype
branch = TreeBranch(Tree=object.Geometry, Path=item_2, MaintainPaths=True)
geo = Geometry(branch)
csokv = CreateSpeckleObjectByKeyValue(Keys=layer.Name, Values=object.Object, selectedKitName="Objects")
loop_slider = PythonScript(
    SliderToModify=variant,
    Min="0",
    Max=Slider(11, range=0..100),
    stepSize="1",
    Delay=upload_delay_s,
    Run=export,
    Reset=reset)  # inputs Run: Boolean, Reset: Boolean
# ---------- loop_slider: Python ----------
import time

def updateSliderInput(inputName,min,max,value,decimalPlace=2):
    for input in ghenv.Component.Params.Input:
        for source in input.Sources:
            if input.Name == str(inputName):
                source.Slider.DecimalPlaces = decimalPlace
                source.Slider.Minimum = min
                source.Slider.Maximum = max
                source.Slider.Value = value
                source.ExpireSolution(True)

def countDecimal(number):
    string= str(number)
    return string[::-1].find('.')

if Run == True:
    if SliderToModify < Max:
        time.sleep(Delay)
        updateSliderInput("SliderToModify",Min,Max,SliderToModify+stepSize,countDecimal(stepSize))
if Reset == True:
    updateSliderInput("SliderToModify",Min,Max,Min)
# ---------- end loop_slider ----------
item_3 = ListItem(List=flatten(csokv), Index=variant, Wrap=True)
item_4 = ListItem(List=flatten(trim_6), Index=variant, Wrap=True)
panel_10 = Panel(item_4)
# https://app.speckle.systems/explorer
# 
# {
#   activeUser {
#     projects {
#       items {
#         models {
#           items {
#             id
#             name
#           }
#         }
#       }
#     }
#   }
# }
# mutation DeleteModel($input: DeleteModelInput!) {
#   modelMutations {
#     delete(input: $input)
#   }
# }
# 
# {
#   "input": {
#     "projectId": "e7de1a2f8f",
#     "id": ""
#   }
# }
receive = Receive(
    Stream=panel_10,
    AutoReceive=False,
    CurrentComponentState="expired",
    ExpandOutput=True,
    LastInfoMessage="Ueli Saluz @ 08/13/2024 13:58:56: Pushed 3 elements from Grasshopper. (id:034ab4e6c2)",
    ReceiveOnOpen=False,
    ReceivedCommitId="034ab4e6c2",
    StreamWrapper="https://app.speckle.systems/projects/e7de1a2f8f/models/cylindric tambour/single storey/1to500/volume",
    selectedKitName="Objects")  # -> Info, Elements, Representation
dso = DeconstructSpeckleObject(SpeckleObject=receive.Representation, selectedKitName="Objects")

# ---- group: Synchronize all representations with speckle NOTE: It can take quite long depending on the delay. (continued)
send = Send(
    Stream=item_4,
    Representation=item_3,
    AutoSend=False,
    BaseId="8aab74125e505f92a95d7aa77a7c5d25",
    CurrentComponentState="up_to_date",
    KitName="Objects",
    OutputWrappers="https://app.speckle.systems\te7de1a2f8f\t30af7d2fe1",
    UseDefaultCache=True,
    selectedKitName="Objects")
