# Grasshopper definition nakagincapsuletower.gh (Grasshopper 1.0.7)
# plug-ins: Pufferfish, Semio.Grasshopper, eleFront

genes = GenePool(Decimals=0, Maximum=20, Minimum=0, Value=[2, 5, 8])
number_slider = Slider(11, range=1..20)
toggle = BooleanToggle(False)
toggle_2 = BooleanToggle(True)
toggle_3 = BooleanToggle(True)
toggle_4 = BooleanToggle(False)
merge = Merge(
    Data1=toggle_2,
    Data2=toggle,
    Data3=toggle,
    Data4=toggle,
    Data5=toggle_2,
    Data6=toggle_2,
    Data7=toggle,
    Data8=toggle_2,
    Data9=toggle,
    Data10=toggle_2)
repeat = RepeatData(Data=Toggle(False), Length=Slider(9, range=1..20))
repeat_2 = RepeatData(Data=Toggle(False), Length=number_slider)
merge_2 = Merge(
    Data1=toggle_4,
    Data2=toggle_3,
    Data3=toggle_3,
    Data4=toggle_4,
    Data5=toggle_3,
    Data6=toggle_4,
    Data7=toggle_4,
    Data8=toggle_4,
    Data9=toggle_3)
invbool = InvertBoolean(Boolean=merge)  # -> Inverted, Number
trim = TrimTree(Tree=repeat, Depth=1)
trim_2 = TrimTree(Tree=repeat_2, Depth=1)
invbool_2 = InvertBoolean(Boolean=trim_2)  # -> Inverted, Number
invbool_3 = InvertBoolean(Boolean=trim)  # -> Inverted, Number
merge_3 = Merge(
    Data1=toggle_4,
    Data2=toggle_4,
    Data3=toggle_4,
    Data4=toggle_4,
    Data5=toggle_4,
    Data6=toggle_4,
    Data7=toggle_4,
    Data8=toggle_3,
    Data9=toggle_3)
merge_4 = Merge(Data1=merge, Data2=toggle)
merge_5 = Merge(Data1=invbool.Inverted, Data2=toggle)
invbool_4 = InvertBoolean(Boolean=merge_2)  # -> Inverted, Number
list = ValueList({"Front", "Right", "Bottom", "Left"}, selected="Bottom")
list_2 = ValueList({"Front", "Right", "Bottom", "Left"}, selected="Bottom")
cluster = Cluster(
    numberoffloors=number_slider,
    bridge=list_2,
    bridgelevels=genes,
    largetower=Toggle(True),
    entrancepatternnorth1=merge_4,
    entrancepatternfront2=trim_2,
    entrancepatterneast1=invbool_2.Inverted,
    entrancepatterneast2=invbool_2.Inverted,
    entrancepatternsouth1=trim_2,
    entrancepatternsouth2=trim_2,
    entrancepatternwest1=invbool_2.Inverted,
    entrancepatternwest2=merge_5,
    windowpatternnorth1=trim_2,
    windowpatternfront2=trim_2,
    windowpatterneast1=trim_2,
    windowpatterneast2=trim_2,
    windowpatternsouth1=trim_2,
    windowpatternsouth2=invbool_2.Inverted,
    windowpatternwest1=invbool_2.Inverted,
    windowpatternwest2=trim_2)  # -> sobject, connection
cluster_2 = Cluster(
    numberoffloors=number_slider,
    bridge=list,
    bridgelevels=genes,
    largetower=Toggle(False),
    entrancepatternnorth1=trim,
    entrancepatternfront2=merge_2,
    entrancepatterneast1=invbool_4.Inverted,
    entrancepatterneast2=trim,
    entrancepatternsouth1=invbool_3.Inverted,
    entrancepatternsouth2=trim,
    entrancepatternwest1=invbool_3.Inverted,
    entrancepatternwest2=invbool_3.Inverted,
    windowpatternnorth1=trim,
    windowpatternfront2=trim,
    windowpatterneast1=trim,
    windowpatterneast2=trim,
    windowpatternsouth1=merge_3,
    windowpatternsouth2=trim,
    windowpatternwest1=trim,
    windowpatternwest2=trim)  # -> sobject, connection
panel = Panel("_")
series = Series(Start=0, Step=1, Count=10)
pce = ModelPiece(Id="b", TypeName="base")  # -> Piece, Id, TypeName, TypeQualities
pce_2 = ModelPiece(Id="s1", TypeName="shaft")  # -> Piece, Id, TypeName, TypeQualities
pce_3 = ModelPiece(Id="s0", TypeName="shaft")  # -> Piece, Id, TypeName, TypeQualities
concat = Concatenate(FragmentB="c")
trim_3 = TrimTree(Tree=series, Depth=1)
panel_2 = Panel("we")
pce_4 = ModelPiece(TypeName="shaft")  # -> Piece, Id, TypeName, TypeQualities
pce_5 = ModelPiece(TypeName="shaft")  # -> Piece, Id, TypeName, TypeQualities
spc = ModelSpecifier(Context="core", Group="0")  # -> Specifier, Context, Group
spc_2 = ModelSpecifier(Context="bottom", Group="true")  # -> Specifier, Context, Group
spc_3 = ModelSpecifier(Context="core", Group="1")  # -> Specifier, Context, Group
sde = ModelSide(PieceId=pce.Id, PieceTypePortSpecifiers=spc.Specifier)  # -> Side, PieceId, PieceTypePortSpecifiers
sde_2 = ModelSide(PieceId=pce_3.Id, PieceTypePortSpecifiers=spc_2.Specifier)  # -> Side, PieceId, PieceTypePortSpecifiers
sde_3 = ModelSide(PieceId=pce.Id, PieceTypePortSpecifiers=spc_3.Specifier)  # -> Side, PieceId, PieceTypePortSpecifiers
sde_4 = ModelSide(PieceId=pce_2.Id, PieceTypePortSpecifiers=spc_2.Specifier)  # -> Side, PieceId, PieceTypePortSpecifiers
atr = ModelAttraction(AttractingSide=sde_3.Side, AttractedSide=sde_4.Side)  # -> Attraction, AttractingSide, AttractedSide
atr_2 = ModelAttraction(AttractingSide=sde.Side, AttractedSide=sde_2.Side)  # -> Attraction, AttractingSide, AttractedSide
kit = CreateKit(
    Name="metabolism",
    Explanation="Everything for metabolistic architecture.",
    Icon="🫀",
    Url="https://github.com/usalu/semio/examples/metabolism",
    Run=Toggle(False))
kit_2 = DeleteKit(Run=Toggle(False))
merge_6 = Merge(Data1=pce.Piece, Data2=pce_3.Piece, Data3=pce_2.Piece)
merge_7 = Merge(Data1=atr_2.Attraction, Data2=atr.Attraction)
kit_3 = LoadKit(Run=Toggle(True))  # -> Name, Explanation, Icon, Url, Types, Formations
for = ModelFormation(
    Name="nakagin capsule tower",
    Explanation="The former Nakagin Capsule Tower from Tokyio.",
    Icon="🏯",
    Pieces=merge_6,
    Attractions=merge_7)  # -> Formation, Name, Explanation, Icon, Pieces, Attractions, Qualities
toggle_5 = BooleanToggle(True)
typ = ModelType(Type=kit_3.Types)  # -> Type, Name, Explanation, Icon, Representations, Ports, Qualities
for_2 = ModelFormation(Formation=kit_3.Formations)  # -> Formation, Name, Explanation, Icon, Pieces, Attractions, Qualities
for_3 = RemoveFormation(FormationName="nakagin capsule tower", Run=toggle_5)
rep = ModelRepresentation(Representation=typ.Representations)  # -> Representation, flatten(Url), LevelOfDetail, Tags
or = GateOr(A=toggle_5, B=for_3)
for_4 = AddFormation(Formation=for.Formation, Run=or)
filter = StreamFilter(Gate=Toggle(False), Stream0="1to500", Stream1="1to200")
scn = GetScene(FormationName="nakagin capsule tower", Run=for_4)
scn_2 = FilterScene(Scene=scn, LevelOfDetails=filter)  # -> Representations, Planes, PiecesIds, ParentsPiecesIds

rp = Representation(scn_2.Representations)
pln = Plane(scn_2.Planes)
trim_4 = TrimTree(Tree=pln, Depth=1)  # -> graft(Tree)
trim_5 = TrimTree(Tree=rp, Depth=1)
rep_2 = ModelRepresentation(Representation=trim_5)  # -> Representation, Url, LevelOfDetail, Tags
box = DomainBox(Base=PlaneXY(0, 0, 0), X=Domain(-2, 2), Y=Domain(-0.5, 0.5), Z=Domain(0, 0.25))
pl2pl = MoveObjectPlaneToPlane(G=box, S=PlaneXY(0, 0, 0), T=trim_4)  # -> TG, T; inputs S: Plane, T: Plane
# ---------- pl2pl: Python ----------
#Component Information
#--------------------------------------------------------------------------------------------
if ghenv.Component.RunCount<2:
    #General
    #--------------------------------------------------------------------------------------------
    __author__ = "Ueli Saluz"
    __version__ = "2023.02.12"
    
    ghenv.Component.Name = "MoveObjectPlaneToPlane"
    ghenv.Component.NickName = "Pl2Pl"
    ghenv.Component.Description = "Moves abitrary geometry from a source plane to a target plane."
    ghenv.Component.Message = "VER 1.2"
    ghenv.Component.Category = "Transform"
    ghenv.Component.SubCategory = "Euclidean"
    
     #Inputs
    #--------------------------------------------------------------------------------------------
    inputIndex=0
    
    ghenv.Component.Params.Input[inputIndex].Name = "Geometry"
    ghenv.Component.Params.Input[inputIndex].NickName = "G"
    ghenv.Component.Params.Input[inputIndex].Description = "Geometry to move."
    ghenv.Component.Params.Input[inputIndex].Optional = False
    inputIndex+=1
    
    ghenv.Component.Params.Input[inputIndex].Name = "SourcePlane"
    ghenv.Component.Params.Input[inputIndex].NickName = "S"
    ghenv.Component.Params.Input[inputIndex].Description = "Source plane of object."
    ghenv.Component.Params.Input[inputIndex].Optional = False
    inputIndex+=1
    
    ghenv.Component.Params.Input[inputIndex].Name = "TargetPlane"
    ghenv.Component.Params.Input[inputIndex].NickName = "T"
    ghenv.Component.Params.Input[inputIndex].Description = "Target plane of object."
    ghenv.Component.Params.Input[inputIndex].Optional = False
    inputIndex+=1
    
    #Outputs
    #--------------------------------------------------------------------------------------------
    outputIndex=0
    
    ghenv.Component.Params.Output[outputIndex].Name = "TranslatedGeometry"
    ghenv.Component.Params.Output[outputIndex].NickName = "TG"
    ghenv.Component.Params.Output[outputIndex].Description = "Translated geometry in target plane."
    outputIndex+=1
    
    ghenv.Component.Params.Output[outputIndex].Name = "Trasnform"
    ghenv.Component.Params.Output[outputIndex].NickName = "T"
    ghenv.Component.Params.Output[outputIndex].Description = "Transform describing translation form source to target plane."
    outputIndex+=1


#Imports
#--------------------------------------------------------------------------------------------
import Rhino.Geometry.Transform as trsf

def MvObjPlnToPln (geo,plnObj,plnDest):
    transform = trsf.PlaneToPlane(plnObj,plnDest)
    geo.Transform(transform)
    return (geo,transform)

TG, T = MvObjPlnToPln(G,S,T)
# ---------- end pl2pl ----------
curdir = CurrentDirectory()  # -> D, P, S
# ---------- curdir: Python ----------
#Component Information
#--------------------------------------------------------------------------------------------
if ghenv.Component.RunCount<2:
    #General
    #--------------------------------------------------------------------------------------------
    __author__ = "Ueli Saluz"
    __version__ = "2023.09.29"
    
    ghenv.Component.Name = "CurrentDirectory"
    ghenv.Component.NickName = "CurDir"
    ghenv.Component.Description = "Current directory of the current grasshopper file."
    ghenv.Component.Message = "VER 1.0"
    ghenv.Component.Category = "Params"
    ghenv.Component.SubCategory = "Util"
    
    #Outputs
    #--------------------------------------------------------------------------------------------
    outputIndex=0
    
    ghenv.Component.Params.Output[outputIndex].Name = "Directory"
    ghenv.Component.Params.Output[outputIndex].NickName = "D"
    ghenv.Component.Params.Output[outputIndex].Description = "Directory of the current grasshopper file."
    outputIndex+=1
    
    ghenv.Component.Params.Output[outputIndex].Name = "Path"
    ghenv.Component.Params.Output[outputIndex].NickName = "P"
    ghenv.Component.Params.Output[outputIndex].Description = "Path of the current grasshopper file."
    outputIndex+=1
    
    ghenv.Component.Params.Output[outputIndex].Name = "Separator"
    ghenv.Component.Params.Output[outputIndex].NickName = "S"
    ghenv.Component.Params.Output[outputIndex].Description = "Separator of the current system."
    outputIndex+=1

#Imports
#--------------------------------------------------------------------------------------------
from os.path import dirname
from os import sep

#Solver - Run with trees to enhance performance drastically
#--------------------------------------------------------------------------------------------
if __name__ == "__main__":
    P = ghenv.Component.OnPingDocument().FilePath
    D = dirname(P)
    S = sep
# ---------- end curdir ----------
concat_2 = Concatenate(FragmentA=curdir.D, FragmentB=curdir.S, FragmentC=rep_2.Url)
refbake = ReferenceByBakeName(FilePath=concat_2, BakeName="*", Key="*", Val="*", lightweight=False)
mtchanc = MatchAncestor(AT=pl2pl.T, CT=graft(refbake))  # -> MAT; inputs AT: tree, CT: tree
# ---------- mtchanc: Python ----------
if ghenv.Component.RunCount<2:
    __author__ = "Ueli Saluz"
    __version__ = "2022.04.25"
    
    ghenv.Component.Name = "Match Ancestor"
    ghenv.Component.NickName = "MtchAnc"
    ghenv.Component.Description = "Duplicates all elements of an ancestor tree to match the amount of elements in the child tree."
    ghenv.Component.Message = "VER 1.1"
    
    ghenv.Component.Params.Input[0].Name = "AncestorTree"
    ghenv.Component.Params.Input[0].NickName = "AT"
    ghenv.Component.Params.Input[0].Description = "Ancestor tree that data will the duplicated until it matches the child tree"
    ghenv.Component.Params.Input[0].Optional = False
    
    ghenv.Component.Params.Input[1].Name = "ChildTree"
    ghenv.Component.Params.Input[1].NickName = "CT"
    ghenv.Component.Params.Input[1].Description = "Child tree that branches will the guide to duplicat the data of the ancestor tree"
    ghenv.Component.Params.Input[0].Optional = False
    
    ghenv.Component.Params.Output[0].Name = "MatchedAncestorTree"
    ghenv.Component.Params.Output[0].NickName = "MAT"
    ghenv.Component.Params.Output[0].Description = "Matched ancestor tree with the amount of items and the branch paths of the child tree"

from System import Object
from Grasshopper import DataTree

"""Returns a new tree with the ancestor data being duplicated along all child branches which where child paths of that ancestor.
    Inputs:
        ancestorTree: Ancestor tree that data will the duplicated until it matches the child tree
        childTree: Child tree that branches will the guide to duplicat the data of the ancestor tree
    Output:
        matchedAncestorTree: Matched ancestor tree with the amount of items and the branch paths of the child tree"""
def MatchAncestorTreeToChildTree (ancestorTree, childTree):
    
    matchedAncestorTree = DataTree[Object]()
    dummy = 0
    for i,pathAncestor in enumerate(ancestorTree.Paths):
        branch = ancestorTree.Branch(pathAncestor)
        if len(branch)!=1:
            raise Exception("Ancestor must be grafted and containing one item per branch")
        #The item to be duplicated
        item = branch[0]
        for j,pathChild in enumerate(childTree.Paths):
            #Returns a tuple and not like in the documentation described a bool with a pointer to the int to store the generations
            checkAncestor = pathChild.IsAncestor(pathAncestor,dummy)
            if(checkAncestor[0]):
                matchedAncestorTree.AddRange([item]*childTree.Branch(pathChild).Count,pathChild)
    return matchedAncestorTree

if __name__ == "__main__":
    MAT = MatchAncestorTreeToChildTree (AT,CT)
# ---------- end mtchanc ----------
trim_6 = TrimTree(Tree=mtchanc, Depth=1)
transform = Transform(Geometry=refbake, Transform=trim_6)
geo = Geometry(transform)

previewplane = PreviewPlane(plane=pln, axis_length=Slider(200, range=0..1000))
panel_3 = Panel(geo)

# ==== cluster Cluster
entrancepatternsouth1 = ClusterInput()
entrancepatternsouth2 = ClusterInput()
entrancepatternnorth1 = ClusterInput()
entrancepatterneast2 = ClusterInput()
entrancepatternwest1 = ClusterInput()
entrancepatternwest2 = ClusterInput()
entrancepatternfront2 = ClusterInput()
entrancepatterneast1 = ClusterInput()
windowpatternnorth1 = ClusterInput()
windowpatternsouth1 = ClusterInput()
windowpatternsouth2 = ClusterInput()
windowpatternfront2 = ClusterInput()
windowpatternwest1 = ClusterInput()
windowpatterneast2 = ClusterInput()
windowpatterneast1 = ClusterInput()
windowpatternwest2 = ClusterInput()
entrancepatternnorth1_2 = Integer(entrancepatternnorth1)
entrancepatterneast2_2 = Integer(entrancepatterneast2)
entrancepatterneast1_2 = Integer(entrancepatterneast1)
entrancepatternsouth2_2 = Integer(entrancepatternsouth2)
entrancepatternfront2_2 = Integer(entrancepatternfront2)
entrancepatternsouth1_2 = Integer(entrancepatternsouth1)
entrancepatternwest1_2 = Integer(entrancepatternwest1)
entrancepatternwest2_2 = Integer(entrancepatternwest2)
windowpatternnorth1_2 = Integer(windowpatternnorth1)
windowpatterneast2_2 = Integer(windowpatterneast2)
windowpatterneast1_2 = Integer(windowpatterneast1)
windowpatternsouth2_2 = Integer(windowpatternsouth2)
windowpatternfront2_2 = Integer(windowpatternfront2)
windowpatternwest1_2 = Integer(windowpatternwest1)
windowpatternsouth1_2 = Integer(windowpatternsouth1)
windowpatternwest2_2 = Integer(windowpatternwest2)
number_slider = Slider(420, range=0..1000)
number_slider_2 = Slider(270, range=0..1000)
number_slider_3 = Slider(275, range=0..1000)
list = ValueList({"Round", "Rectangular"}, selected="Round")
list_2 = ValueList({"Back", "Side"}, selected="Back")
panel = Panel("""Back
Side""")
panel_2 = Panel("""Back
Side""")
list_3 = ValueList({"Front", "Side"}, selected="Front")
qlt = ModelQuality(Name="Entrance", Value=list_2)  # -> Quality, Name, Value, Unit
qlt_2 = ModelQuality(Name="Window", Value=list)  # -> Quality, Name, Value, Unit
qlt_3 = ModelQuality(Name="Mirror", Value=Toggle(True))  # -> Quality, Name, Value, Unit
panel_3 = Panel("Length")
list_4 = ValueList({"Back", "Side"}, selected="Side")
panel_4 = Panel("Width")
panel_5 = Panel("Height")
panel_6 = Panel("Entrance")
panel_7 = Panel("Window")
item = ListItem(List=panel, Index=entrancepatternnorth1_2, Wrap=True)  # -> graft(Item)
item_2 = ListItem(List=panel, Index=entrancepatternfront2_2, Wrap=True)  # -> graft(Item)
item_3 = ListItem(List=panel, Index=entrancepatterneast1_2, Wrap=True)  # -> graft(Item)
item_4 = ListItem(List=panel, Index=entrancepatterneast2_2, Wrap=True)  # -> graft(Item)
item_5 = ListItem(List=panel, Index=entrancepatternsouth1_2, Wrap=True)  # -> graft(Item)
item_6 = ListItem(List=panel, Index=entrancepatternsouth2_2, Wrap=True)  # -> graft(Item)
item_7 = ListItem(List=panel, Index=entrancepatternwest1_2, Wrap=True)  # -> graft(Item)
item_8 = ListItem(List=panel, Index=entrancepatternwest2_2, Wrap=True)  # -> graft(Item)
item_9 = ListItem(List=panel_2, Index=windowpatternnorth1_2, Wrap=True)  # -> graft(Item)
item_10 = ListItem(List=panel_2, Index=windowpatternfront2_2, Wrap=True)  # -> graft(Item)
item_11 = ListItem(List=panel_2, Index=windowpatterneast1_2, Wrap=True)  # -> graft(Item)
item_12 = ListItem(List=panel_2, Index=windowpatterneast2_2, Wrap=True)  # -> graft(Item)
item_13 = ListItem(List=panel_2, Index=windowpatternsouth1_2, Wrap=True)  # -> graft(Item)
item_14 = ListItem(List=panel_2, Index=windowpatternsouth2_2, Wrap=True)  # -> graft(Item)
item_15 = ListItem(List=panel_2, Index=windowpatternwest1_2, Wrap=True)  # -> graft(Item)
item_16 = ListItem(List=panel_2, Index=windowpatternwest2_2, Wrap=True)  # -> graft(Item)
merge = Merge()
numberoffloors = ClusterInput()
largetower = ClusterInput()
bridgelevels = ClusterInput()
bridge = ClusterInput()
numberoffloors_2 = Integer(numberoffloors)
dup = DuplicateData(Number=numberoffloors_2, Order=True)
dup_2 = DuplicateData(Number=numberoffloors_2, Order=True)
largetower_2 = Boolean(largetower)
bridge_2 = Text(bridge)
bridgelevels_2 = Integer(bridgelevels)
trim = TrimTree(Tree=dup, Depth=1)
trim_2 = TrimTree(Tree=dup_2, Depth=1)
flip = FlipMatrix(Data=trim)
flip_2 = FlipMatrix(Data=trim_2)
series = Series(Start=0, Step=1, Count=numberoffloors_2)
merge_2 = Merge(Data1=flip)
merge_3 = Merge(Data1=flip_2)
panel_10 = Panel("SecondDoor")
panel_11 = Panel("Floors")
trim_3 = TrimTree(Tree=series, Depth=1)
panel_12 = Panel("Bridge")
panel_13 = Panel("Floor")
panel_14 = Panel("Door")
panel_15 = Panel("1")
panel_16 = Panel("2")
panel_18 = Panel("3")
spc = ModelSpecifier(Context="SplitLevel", Group="2")  # -> Specifier, Context, Group
spc_2 = ModelSpecifier(Context="SplitLevel", Group="1")  # -> Specifier, Context, Group
expression = Expression(Expression="x")
expression_2 = Expression(Expression="x")
expression_3 = Expression(Expression="x")
expression_4 = Expression(Expression="x")
expression_5 = Expression(Expression="x")
expression_6 = Expression(Expression="x")
merge_4 = Merge(Data1=merge_3)
merge_5 = Merge(Data1=merge_3)
merge_6 = Merge(Data1=merge_2)
merge_7 = Merge(Data1=merge_3)
merge_8 = Merge(Data1=merge_2)
merge_9 = Merge(Data1=merge_3)
merge_10 = Merge(Data1=merge_2)
merge_11 = Merge(Data1=merge_2)
relay = Relay()
relay_2 = Relay()
relay_3 = Relay()
relay_4 = Relay()
relay_5 = Relay()
relay_6 = Relay()
relay_7 = Relay()
relay_8 = Relay()
trim_4 = TrimTree(Tree=relay_6, Depth=1)
trim_5 = TrimTree(Tree=relay_3, Depth=1)
trim_6 = TrimTree(Tree=relay_7, Depth=1)
trim_7 = TrimTree(Tree=relay_5, Depth=1)
trim_8 = TrimTree(Tree=relay_8, Depth=1)
trim_9 = TrimTree(Tree=relay_4, Depth=1)
trim_10 = TrimTree(Tree=relay, Depth=1)
trim_11 = TrimTree(Tree=relay_2, Depth=1)
trim_12 = TrimTree(Depth=1)
trim_13 = TrimTree(Depth=1)
trim_14 = TrimTree(Depth=1)
trim_15 = TrimTree(Depth=1)
trim_16 = TrimTree(Depth=1)
trim_17 = TrimTree(Depth=1)
trim_18 = TrimTree(Depth=1)
trim_19 = TrimTree(Depth=1)
lng = ListLength(List=bridgelevels_2)
replace = ReplaceItems(List=trim_11, Indices=bridgelevels_2, Wrap=False)
cull_i = CullIndex(List=trim_7, Indices=bridgelevels_2, Wrap=True)
dup_3 = DuplicateData(Number=lng, Order=True)
trim_20 = TrimTree(Tree=replace, Depth=1)
trim_21 = TrimTree(Tree=cull_i, Depth=1)
cull_i_2 = CullIndex(List=trim_18, Indices=bridgelevels_2, Wrap=True)
replace_2 = ReplaceItems(List=trim_17, Indices=bridgelevels_2, Wrap=False)
trim_22 = TrimTree(Tree=dup_3, Depth=1)
filter = StreamFilter(Gate=largetower_2, Stream0=trim_11, Stream1=trim_20)
panel_20 = Panel(trim_22)
filter_2 = StreamFilter(Gate=largetower_2, Stream0=trim_21, Stream1=trim_7)
trim_23 = TrimTree(Tree=cull_i_2, Depth=1)
trim_24 = TrimTree(Tree=replace_2, Depth=1)
merge_12 = Merge(Data1=trim_5, Data2=trim_9, Data3=trim_10, Data4=filter)
filter_3 = StreamFilter(Gate=largetower_2, Stream0=trim_23, Stream1=trim_18)
filter_4 = StreamFilter(Gate=largetower_2, Stream0=trim_17, Stream1=trim_24)
merge_13 = Merge(Data1=trim_8, Data2=trim_4, Data3=trim_6, Data4=filter_2)
merge_14 = Merge(Data1=trim_12, Data2=filter_3, Data3=trim_13, Data4=trim_14)
merge_15 = Merge(Data1=trim_15, Data2=trim_19, Data3=trim_16, Data4=filter_4)
merge_16 = Merge(Data1=merge_13, Data2=merge_12)
merge_17 = Merge(Data1=merge_14, Data2=merge_15)
merge_18 = Merge(Data2=merge_16)
merge_19 = Merge(Data1=merge_17)
run = Boolean(Toggle(False))
server = Text("http://localhost:2999")
connection = ClusterOutput()
sobject = ClusterOutput()
panel_21 = Panel("All")
panel_22 = Panel("Doors")

# ==== cluster PreviewPlane: Preview a plane with axis colors and naming.
axis_length = ClusterInput()
plane = ClusterInput()
axis_length_2 = Number(axis_length)
plane_2 = Plane(plane)
deplane = DeconstructPlane(Plane=plane_2)  # -> Origin, XAxis, YAxis, ZAxis
line = LineSDL(Start=deplane.Origin, Direction=deplane.YAxis, Length=axis_length_2)
line_2 = LineSDL(Start=deplane.Origin, Direction=deplane.XAxis, Length=axis_length_2)
line_3 = LineSDL(Start=deplane.Origin, Direction=deplane.ZAxis, Length=axis_length_2)
swatch = ColourSwatch(SwatchColor=RGB(235, 52, 79))
swatch_2 = ColourSwatch(SwatchColor=RGB(0, 166, 157))
swatch_3 = ColourSwatch(SwatchColor=RGB(240, 117, 24))
end = EndPoints(Curve=line_2)  # -> Start, End
end_2 = EndPoints(Curve=line)  # -> Start, End
end_3 = EndPoints(Curve=line_3)  # -> Start, End
tag = TextTag(Location=end.End, Text="X", Colour=swatch)
tag_2 = TextTag(Location=end_2.End, Text="Y", Colour=swatch_2)
tag_3 = TextTag(Location=end_3.End, Text="Z", Colour=swatch_3)
preview = CustomPreview(Geometry=line_2, Material=swatch)
preview_2 = CustomPreview(Geometry=line, Material=swatch_2)
preview_3 = CustomPreview(Geometry=line_3, Material=swatch_3)
