# Grasshopper definition assess-perfomance.gh (Grasshopper 1.0.8)
# Copyright: GNU Lesser General Public License Version 3
# plug-ins: semio

kt = Kit("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")
kit = ModelKit(Kit=kt)  # -> Kit, Valid, Name, Description, Icon, Image, Preview, Version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
typ = ModelType(Type=kit.Types)  # -> Type, Valid, Name, Description, Icon, Image, Variant, Stock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
dsn = ModelDesign(Design=kit.Designs)  # -> Design, Valid, Name, Description, Icon, Image, Variant, View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
con = ModelConnection(Connection=dsn.Connections)  # -> Connection, Valid, ConnectedPieceId, ConnectedPieceTypePortId, ConnectingPieceId, ConnectingPieceTypePortId, Description, Gap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
item = ListItem(List=kit.Designs, Index=0, Wrap=True)  # -> Item, Item1
por = ModelPort(Port=typ.Ports)  # -> Port, Valid, Id, Description, Mandatory, Family, CompatibleFamilies, Point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
rep = ModelRepresentation(Representation=typ.Representations)  # -> Representation, Valid, Url, Description, Tags, Qualities
pce = ModelPiece(Piece=dsn.Pieces)  # -> Piece, Valid, Id, Description, TypeName, TypeVariant, Plane, Center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
panel = Panel(dsn.Pieces)
merge = Merge(Data1=item.Item, Data2=item.Item)
dn = Design(flatten(merge))
ty = Type(flatten(kit.Types))
prf = AssessPerformance(dn=dn, ty=ty)  # -> dn_3, interest_2, area_efficiency_eff_m²_m²_2, area_comfort_m²_person_2, income_a_3, expenses_a_3, energy_expenses_a_3, effective_floor_area_m²_12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

# ==== cluster AssessPerformance: Simple performance assement based on the following qualities of the types (No unit conversion is applied for now, so make sure that all your types have the values with the same unit.): floor area, effective floor area, residents, workspaces, construction cost, maintenance expenses, income, transmission heat loss, ventilation heat loss, cooling energy demand, technical equipment energy demand,construction global warming potential, heating load, cooling load, ventilation air flow volume
dn = ClusterInput()
ty = ClusterInput()
technical_equipment_cost = ClusterInput()
technical_equipment_gwp_kgco2e = ClusterInput()
ventilation_heat_recovery_factor = ClusterInput()
heating_efficiency_factor = ClusterInput()
heating_primary_energy_factor = ClusterInput()
heating_energy_price_kwh = ClusterInput()
heating_global_warming_potential_kgco2e = ClusterInput()  # "Heating Global Warming Potential [kgCO2e/kWh]"
cooling_efficiency_factor = ClusterInput()
cooling_primary_energy_factor = ClusterInput()
cooling_global_warming_potential_kgco2e = ClusterInput()  # "Cooling Global Warming Potential [kgCO2e/kWh]"
cooling_energy_price_kwh = ClusterInput()
electrictiy_primary_energy_factor = ClusterInput()
electrictiy_global_warming_potential_kgc = ClusterInput()  # "Electrictiy Global Warming Potential [kgCO2e/kWh]"
electrictiy_energy_price_kwh = ClusterInput()
co2_price_tco2e = ClusterInput()
life_cycle_a = ClusterInput()
dn_2 = Design(graft(dn))
dsn = ModelDesign(Design=dn_2)  # -> Design, Valid, Name, Description, Icon, Image, Variant, View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
trim = TrimTree(Tree=dsn.Pieces, Depth=1)
electrictiy_energy_price_kwh_2 = Number(electrictiy_energy_price_kwh)
heating_primary_energy_factor_2 = Number(heating_primary_energy_factor)
heating_energy_price_kwh_2 = Number(heating_energy_price_kwh)
heating_global_warming_potential_kgco2e_2 = Number(heating_global_warming_potential_kgco2e)  # "Heating Global Warming Potential [kgCO2e/kWh]"
cooling_energy_price_kwh_2 = Number(cooling_energy_price_kwh)
electrictiy_primary_energy_factor_2 = Number(electrictiy_primary_energy_factor)
ventilation_heat_recovery_factor_2 = Number(ventilation_heat_recovery_factor)
heating_efficiency_factor_2 = Number(heating_efficiency_factor)
cooling_efficiency_factor_2 = Number(cooling_efficiency_factor)
cooling_primary_energy_factor_2 = Number(cooling_primary_energy_factor)
cooling_global_warming_potential_kgco2e_2 = Number(cooling_global_warming_potential_kgco2e)  # "Cooling Global Warming Potential [kgCO2e/kWh]"
electrictiy_global_warming_potential_kgc_2 = Number(electrictiy_global_warming_potential_kgc)  # "Electrictiy Global Warming Potential [kgCO2e/kWh]"
co2_price_tco2e_2 = Number(co2_price_tco2e)
life_cycle_a_2 = Number(life_cycle_a)
ty_2 = Type(ty)

# ----
# explizit definierte Oberkategorie
qal = SumQualities(dn=dn_2, ty=ty_2, na="heating energy demand")  # -> num_2, ql_2

panel = Panel(qal.num_2)
null = NullItem(Item=qal.num_2)  # -> NullFlags, InvalidFlags, Description
technical_equipment_cost_2 = Number(technical_equipment_cost)
technical_equipment_gwp_kgco2e_2 = Number(technical_equipment_gwp_kgco2e)
typ = SelectTypeByPiece(ty=ty_2, pc=trim)  # -> ty_4, i_2
expression = Expression(x=co2_price_tco2e_2, Expression="x/1000")
typ_2 = ModelType(Type=typ.ty_4)  # -> Type, Valid, Name, Description, Icon, Image, Variant, Stock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
co2_price_kgco2e = Number(expression)
txt = Text("heating energy demand")
ql = Quality(typ_2.Qualities)
qal_2 = SelectQuality(ql=ql, na="ventilation heat demand")  # -> graft(ql_4)
qal_3 = SelectQuality(ql=ql, na="transmission heat demand")  # -> graft(ql_4)
qal_4 = ModelQuality(Quality=qal_3)  # -> Quality, Valid, Name, Value, Unit, Definition
qal_5 = ModelQuality(Quality=qal_2)  # -> Quality, Valid, Name, Value, Unit, Definition
# Beispiel
panel_2 = Panel(ql)
qal_6 = SelectQuality(ql=ql, na=txt)  # -> graft(ql_4)
transmission_heat_loss_kwh_a = Number(qal_4.Value)
ventilation_heat_recovery_factor_3 = Number(ventilation_heat_recovery_factor_2)
ventiation_heat_loss_kwh_a = Number(qal_5.Value)
qal_7 = ModelQuality(Quality=qal_6)  # -> Quality, Valid, Name, Value, Unit, Definition
qal_8 = SumQualities(dn=dn_2, ty=ty_2, na="floor area")  # -> num_2, ql_2
qal_9 = SumQualities(dn=dn_2, ty=ty_2, na="effective floor area")  # -> num_2, ql_2
qal_10 = SumQualities(dn=dn_2, ty=ty_2, na="residents")  # -> num_2, ql_2
qal_11 = SumQualities(dn=dn_2, ty=ty_2, na="workspaces")  # -> num_2, ql_2
qal_12 = SumQualities(dn=dn_2, ty=ty_2, na="construction cost")  # -> num_2, ql_2
qal_13 = SumQualities(dn=dn_2, ty=ty_2, na="maintenance expenses")  # -> num_2, ql_2
qal_14 = SumQualities(dn=dn_2, ty=ty_2, na="income")  # -> num_2, ql_2
qal_15 = SumQualities(dn=dn_2, ty=ty_2, na="transmission heat demand")  # -> num_2, ql_2
qal_16 = SumQualities(dn=dn_2, ty=ty_2, na="ventilation heat demand")  # -> num_2, ql_2
qal_17 = SumQualities(dn=dn_2, ty=ty_2, na="cooling energy demand")  # -> num_2, ql_2
qal_18 = SumQualities(dn=dn_2, ty=ty_2, na="technical equipment energy demand")  # -> num_2, ql_2
qal_19 = SumQualities(dn=dn_2, ty=ty_2, na="construction global warming potential")  # -> num_2, ql_2
qal_20 = SumQualities(dn=dn_2, ty=ty_2, na="heating load")  # -> num_2, ql_2
qal_21 = SumQualities(dn=dn_2, ty=ty_2, na="cooling load")  # -> num_2, ql_2
qal_22 = SumQualities(dn=dn_2, ty=ty_2, na="ventilation air flow volume")  # -> num_2, ql_2
expression_2 = Expression(x=ventilation_heat_recovery_factor_3, Expression="1-x")
addition = Addition(A=qal_10.num_2, B=qal_11.num_2)
ventilation_heat_recovery_factor_4 = Number(ventilation_heat_recovery_factor_2)
null_2 = NullItem(Item=qal_6)  # -> NullFlags, InvalidFlags, Description
# NullToBranch nur bei unterster Kategorie
multiplication = Multiplication(A=ventiation_heat_loss_kwh_a, B=expression_2)
users_person = Number(addition)
addition_2 = Addition(A=transmission_heat_loss_kwh_a, B=multiplication)
ventiation_heat_loss_kwh_a_2 = Number(qal_16.num_2)
transmission_heat_loss_kwh_a_2 = Number(qal_15.num_2)
expression_3 = Expression(x=ventilation_heat_recovery_factor_4, Expression="1-x")
nulltobranch = AddNullToEmptyBranch(D=addition_2)  # -> R; inputs D: tree; same code as nulltobranch
replace = ReplaceItems(Wrap=False)
multiplication_2 = Multiplication(A=ventiation_heat_loss_kwh_a_2, B=expression_3)

# ----
# Berechnung Oberkategorie aus Unterkategorien
transmission_heat_loss_kwh_a_3 = Number(qal_15.num_2)
addition_3 = Addition(A=transmission_heat_loss_kwh_a_3, B=multiplication_2)
heating_energy_demand_kwh_a = Number(addition_3)

panel_3 = Panel(heating_energy_demand_kwh_a)
filter = StreamFilter(Gate=null.NullFlags, Stream0=qal.num_2, Stream1=heating_energy_demand_kwh_a)
heating_global_warming_potential_kgco2e_3 = Number(heating_global_warming_potential_kgco2e_2)  # "Heating Global Warming Potential [kgCO2e/kWh]"
electrictiy_global_warming_potential_kgc_3 = Number(electrictiy_global_warming_potential_kgc_2)  # "Electrictiy Global Warming Potential [kgCO2e/kWh]"
cooling_global_warming_potential_kgco2e_3 = Number(cooling_global_warming_potential_kgco2e_2)  # "Cooling Global Warming Potential [kgCO2e/kWh]"
addition_4 = Addition(A=transmission_heat_loss_kwh_a_2, B=multiplication_2)
nullrep = ReplaceNulls(Items=nulltobranch, Replacements="0")  # -> Items, Count
merge = Merge(Data1=qal_7.Value, Data2=nullrep.Items)
panel_4 = Panel(merge)
item = ListItem(List=merge, Index=null_2.NullFlags, Wrap=invert(True))
trim_2 = TrimTree(Tree=item, Depth=1)
num = Number(trim_2)
panel_5 = Panel(num)
panel_6 = Panel(nulltobranch)
item_2 = ListItem(Index=0, Wrap=True)
heating_energy_demand_kwh_a_2 = Number(addition_4)
cooling_energy_demand_kwh_a = Number(qal_17.num_2)
heating_efficiency_factor_3 = Number(heating_efficiency_factor_2)
cooling_efficiency_factor_3 = Number(cooling_efficiency_factor_2)
technical_equipment_energy_demand_kwh_a = Number(qal_18.num_2)
electricity_energy_demand_kwh_a = Number(technical_equipment_energy_demand_kwh_a)
multiplication_3 = Multiplication(A=electricity_energy_demand_kwh_a, B=electrictiy_global_warming_potential_kgc_3)
multiplication_4 = Multiplication(A=heating_energy_demand_kwh_a_2, B=heating_efficiency_factor_3)
final_heating_energy_demand_kwh_a = Number(multiplication_4)
multiplication_5 = Multiplication(A=final_heating_energy_demand_kwh_a, B=heating_global_warming_potential_kgco2e_3)
multiplication_6 = Multiplication(A=cooling_energy_demand_kwh_a, B=cooling_efficiency_factor_3)
final_cooling_energy_demand_kwh_a = Number(multiplication_6)
multiplication_7 = Multiplication(A=final_cooling_energy_demand_kwh_a, B=cooling_global_warming_potential_kgco2e_3)
panel_7 = Panel(addition_2)
heating_global_warming_potential_kgco2e_4 = Number(multiplication_5)  # "Heating Global Warming Potential [kgCO2e/a]"
cooling_global_warming_potential_kgco2e_4 = Number(multiplication_7)  # "Cooling Global Warming Potential [kgCO2e/a]"
electricity_global_warming_potential_kgc = Number(multiplication_3)  # "Electricity Global Warming Potential [kgCO2e/a]"
final_heating_energy_demand_kwh_a_2 = Number(multiplication_4)
final_cooling_energy_demand_kwh_a_2 = Number(multiplication_6)
electricity_energy_demand_kwh_a_2 = Number(technical_equipment_energy_demand_kwh_a)
electrictiy_energy_price_kwh_3 = Number(electrictiy_energy_price_kwh_2)
heating_energy_price_kwh_3 = Number(heating_energy_price_kwh_2)
cooling_energy_price_kwh_3 = Number(cooling_energy_price_kwh_2)
co2_price_kgco2e_2 = Number(co2_price_kgco2e)
co2_price_kgco2e_3 = Number(co2_price_kgco2e)
co2_price_kgco2e_4 = Number(co2_price_kgco2e)
multiplication_8 = Multiplication(A=final_heating_energy_demand_kwh_a_2, B=heating_energy_price_kwh_3)
multiplication_9 = Multiplication(A=electricity_energy_demand_kwh_a_2, B=electrictiy_energy_price_kwh_3)
multiplication_10 = Multiplication(A=final_cooling_energy_demand_kwh_a_2, B=cooling_energy_price_kwh_3)
multiplication_11 = Multiplication(A=heating_global_warming_potential_kgco2e_4, B=co2_price_kgco2e_2)
multiplication_12 = Multiplication(A=cooling_global_warming_potential_kgco2e_4, B=co2_price_kgco2e_3)
multiplication_13 = Multiplication(A=electricity_global_warming_potential_kgc, B=co2_price_kgco2e_4)
electricity_global_warming_potential_kgc_2 = Number(electricity_global_warming_potential_kgc)  # "Electricity Global Warming Potential [kgCO2e/a]"
heating_global_warming_potential_kgco2e_5 = Number(heating_global_warming_potential_kgco2e_4)  # "Heating Global Warming Potential [kgCO2e/a]"
cooling_global_warming_potential_kgco2e_5 = Number(cooling_global_warming_potential_kgco2e_4)  # "Cooling Global Warming Potential [kgCO2e/a]"
heating_energy_price_a = Number(multiplication_8)
cooling_energy_price_a = Number(multiplication_9)
heating_co2_price_a = Number(multiplication_11)
cooling_co2_price_a = Number(multiplication_12)
cooling_energy_price_a_2 = Number(multiplication_10)
electricity_co2_price_a = Number(multiplication_13)
final_heating_energy_demand_kwh_a_3 = Number(final_heating_energy_demand_kwh_a_2)
final_cooling_energy_demand_kwh_a_3 = Number(final_cooling_energy_demand_kwh_a_2)
electricity_energy_demand_kwh_a_3 = Number(electricity_energy_demand_kwh_a_2)
electricity_energy_demand_kwh_a_4 = Number(electricity_energy_demand_kwh_a_2)
electrictiy_primary_energy_factor_3 = Number(electrictiy_primary_energy_factor_2)
heating_primary_energy_factor_3 = Number(heating_primary_energy_factor_2)
final_cooling_energy_demand_kwh_a_4 = Number(final_cooling_energy_demand_kwh_a_2)
cooling_primary_energy_factor_3 = Number(cooling_primary_energy_factor_2)
final_heating_energy_demand_kwh_a_4 = Number(final_heating_energy_demand_kwh_a_2)
building_construction_gwp_kgco2e = Number(qal_19.num_2)
technical_equipment_gwp_kgco2e_3 = Number(technical_equipment_gwp_kgco2e_2)
addition_5 = Addition(A=cooling_energy_price_a_2, B=cooling_co2_price_a)
addition_6 = Addition(A=heating_energy_price_a, B=heating_co2_price_a)
addition_7 = Addition(A=cooling_energy_price_a, B=electricity_co2_price_a)
addition_8 = Addition(
    A=heating_global_warming_potential_kgco2e_5,
    B=cooling_global_warming_potential_kgco2e_5,
    C=electricity_global_warming_potential_kgc_2)
addition_9 = Addition(A=final_heating_energy_demand_kwh_a_3, B=final_cooling_energy_demand_kwh_a_3, C=electricity_energy_demand_kwh_a_4)
multiplication_14 = Multiplication(A=electricity_energy_demand_kwh_a_3, B=electrictiy_primary_energy_factor_3)
multiplication_15 = Multiplication(A=final_heating_energy_demand_kwh_a_4, B=heating_primary_energy_factor_3)
multiplication_16 = Multiplication(A=final_cooling_energy_demand_kwh_a_4, B=cooling_primary_energy_factor_3)
electricity_expenses_a = Number(addition_7)
heating_expenses_a = Number(addition_6)
cooling_expenses_a = Number(addition_5)
energy_global_warming_potential_kgco2e_a = Number(addition_8)
final_energy_demand_kwh_a = Number(addition_9)
primary_heating_energy_demand_kwh_a = Number(multiplication_15)
primary_cooling_energy_demand_kwh_a = Number(multiplication_16)
primary_electricity_energy_demand_kwh_a = Number(multiplication_14)
addition_10 = Addition(A=building_construction_gwp_kgco2e, B=technical_equipment_gwp_kgco2e_3)
addition_11 = Addition(A=heating_expenses_a, B=cooling_expenses_a, C=electricity_expenses_a)
life_cycle_a_3 = Number(life_cycle_a_2)
construction_gwp_kgco2e = Number(addition_10)
maintenance_expenses_a = Number(qal_13.num_2)
energy_expenses_a = Number(addition_11)
multiplication_17 = Multiplication(A=energy_global_warming_potential_kgco2e_a, B=life_cycle_a_3)
addition_12 = Addition(A=primary_heating_energy_demand_kwh_a, B=primary_cooling_energy_demand_kwh_a, C=primary_electricity_energy_demand_kwh_a)
addition_13 = Addition(A=multiplication_17, B=construction_gwp_kgco2e)
addition_14 = Addition(A=maintenance_expenses_a, B=energy_expenses_a)
primary_energy_demand_kwh_a = Number(addition_12)
building_construction_cost = Number(qal_12.num_2)
technical_equipment_cost_3 = Number(technical_equipment_cost_2)
life_cycle_gwp_kgco2e = Number(addition_13)
expenses_a = Number(addition_14)
life_cycle_a_4 = Number(life_cycle_a_2)
multiplication_18 = Multiplication(A=expenses_a, B=life_cycle_a_4)
addition_15 = Addition(A=building_construction_cost, B=technical_equipment_cost_3)
life_cycle_expenses = Number(multiplication_18)
construction_cost = Number(addition_15)
income_a = Number(qal_14.num_2)
life_cycle_a_5 = Number(life_cycle_a_2)

# ----
# Berechnung Oberkategorie aus Unterkategorien
transmission_heat_loss_kwh_a_4 = Number(qal_15.num_2)
addition_16 = Addition(A=transmission_heat_loss_kwh_a_4, B=multiplication_2)
heating_energy_demand_kwh_a_3 = Number(addition_16)

addition_17 = Addition(A=construction_cost, B=life_cycle_expenses)
multiplication_19 = Multiplication(A=income_a, B=life_cycle_a_5)
cooling_energy_demand_kwh_a_2 = Number(cooling_energy_demand_kwh_a)
heating_energy_demand_kwh_a_4 = Number(heating_energy_demand_kwh_a_2)
heating_energy_demand_kwh_a_5 = Number(heating_energy_demand_kwh_a_2)
cooling_energy_demand_kwh_a_3 = Number(cooling_energy_demand_kwh_a)
primary_energy_demand_kwh_a_2 = Number(primary_energy_demand_kwh_a)
primary_energy_demand_kwh_a_3 = Number(primary_energy_demand_kwh_a)
final_energy_demand_kwh_a_2 = Number(final_energy_demand_kwh_a)
final_energy_demand_kwh_a_3 = Number(final_energy_demand_kwh_a)
construction_gwp_kgco2e_2 = Number(construction_gwp_kgco2e)
construction_gwp_kgco2e_3 = Number(construction_gwp_kgco2e)
life_cycle_gwp_kgco2e_2 = Number(life_cycle_gwp_kgco2e)
life_cycle_gwp_kgco2e_3 = Number(life_cycle_gwp_kgco2e)
effective_floor_area_m² = Number(qal_9.num_2)
effective_floor_area_m²_2 = Number(qal_9.num_2)
effective_floor_area_m²_3 = Number(qal_9.num_2)
effective_floor_area_m²_4 = Number(qal_9.num_2)
effective_floor_area_m²_5 = Number(qal_9.num_2)
effective_floor_area_m²_6 = Number(qal_9.num_2)
effective_floor_area_m²_7 = Number(qal_9.num_2)
effective_floor_area_m²_8 = Number(qal_9.num_2)
effective_floor_area_m²_9 = Number(qal_9.num_2)
effective_floor_area_m²_10 = Number(qal_9.num_2)
construction_cost_2 = Number(addition_15)
life_cycle_income = Number(multiplication_19)
construction_cost_3 = Number(addition_15)
life_cycle_cost = Number(addition_17)
life_cycle_cost_2 = Number(addition_17)
life_cycle_cost_3 = Number(addition_17)
floor_area_m² = Number(qal_8.num_2)
users_person_2 = Number(users_person)
users_person_3 = Number(users_person)
users_person_4 = Number(users_person)
users_person_5 = Number(users_person)
users_person_6 = Number(users_person)
users_person_7 = Number(users_person)
users_person_8 = Number(users_person)
users_person_9 = Number(users_person)
users_person_10 = Number(users_person)
division = Division(A=effective_floor_area_m², B=floor_area_m²)
division_2 = Division(A=effective_floor_area_m²_5, B=users_person_5)
division_3 = Division(A=construction_cost_2, B=effective_floor_area_m²_2)
division_4 = Division(A=construction_cost_3, B=users_person_6)
division_5 = Division(A=life_cycle_cost_2, B=effective_floor_area_m²_3)
division_6 = Division(A=life_cycle_cost_3, B=users_person_7)
division_7 = Division(A=construction_gwp_kgco2e_2, B=effective_floor_area_m²_6)
division_8 = Division(A=construction_gwp_kgco2e_3, B=users_person_8)
division_9 = Division(A=life_cycle_gwp_kgco2e_2, B=effective_floor_area_m²_4)
division_10 = Division(A=life_cycle_gwp_kgco2e_3, B=users_person_9)
division_11 = Division(A=primary_energy_demand_kwh_a_2, B=effective_floor_area_m²_7)
division_12 = Division(A=primary_energy_demand_kwh_a_3, B=users_person_10)
division_13 = Division(A=final_energy_demand_kwh_a_2, B=effective_floor_area_m²_8)
division_14 = Division(A=final_energy_demand_kwh_a_3, B=users_person_2)
division_15 = Division(A=heating_energy_demand_kwh_a_4, B=effective_floor_area_m²_9)
division_16 = Division(A=heating_energy_demand_kwh_a_5, B=users_person_3)
division_17 = Division(A=cooling_energy_demand_kwh_a_2, B=effective_floor_area_m²_10)
division_18 = Division(A=cooling_energy_demand_kwh_a_3, B=users_person_4)
expression_4 = Expression(Start=construction_cost, End=life_cycle_income, Expression="((End-Start)/Start)*100")
area_comfort_m²_person = Number(division_2)
life_cycle_cost_4 = Number(life_cycle_cost)
specific_life_cycle_cost_m² = Number(division_5)
construction_global_warming_potential_pe = Number(division_8)  # "Construction Global Warming Potential per User [kgCO2e/Person]"
specific_life_cycle_global_warming_poten = Number(division_9)  # "Specific Life Cycle Global Warming Potential [kgCO2e/m²]"
life_cycle_global_warming_potential_per = Number(division_10)  # "Life Cycle Global Warming Potential per User [kgCO2e/Person]"
primary_energy_demand_kwh_a_4 = Number(primary_energy_demand_kwh_a)
primary_energy_demand_per_user_kwh_perso = Number(division_12)  # "Primary Energy Demand per User [kWh/Person a]"
final_energy_demand_kwh_a_4 = Number(final_energy_demand_kwh_a)
specific_final_energy_demand_kwh_m²a = Number(division_13)
ventilation_air_flow_volume_m³_s = Number(qal_22.num_2)
area_efficiency_eff_m²_m² = Number(division)
income_a_2 = Number(qal_14.num_2)
expenses_a_2 = Number(addition_14)
energy_expenses_a_2 = Number(addition_11)
effective_floor_area_m²_11 = Number(qal_9.num_2)
floor_area_m²_2 = Number(qal_8.num_2)
users_person_11 = Number(users_person)
construction_cost_4 = Number(addition_15)
specific_construction_cost_m² = Number(division_3)
construction_cost_per_user_person = Number(division_4)
life_cycle_cost_per_user_person = Number(division_6)
construction_global_warming_potential_kg = Number(construction_gwp_kgco2e)  # "Construction Global Warming Potential [kgCO2e]"
specific_construction_global_warming_pot = Number(division_7)  # "Specific Construction Global Warming Potential [kgCO2e/m²]"
life_cycle_global_warming_potential_kgco = Number(life_cycle_gwp_kgco2e)  # "Life Cycle Global Warming Potential [kgCO2e]"
specific_primary_energy_demand_kwh_m²a = Number(division_11)
final_energy_demand_per_user_kwh_person = Number(division_14)  # "Final Energy Demand per User [kWh/Person a]"
heating_load_kw = Number(qal_20.num_2)
heating_energy_demand_kwh_a_6 = Number(heating_energy_demand_kwh_a_2)
specific_heating_energy_demand_kwh_m²a = Number(division_15)
heating_energy_demand_per_user_kwh_perso = Number(division_16)  # "Heating Energy Demand per User [kWh/Person a]"
cooling_load_kw = Number(qal_21.num_2)
cooling_energy_demand_kwh_a_4 = Number(cooling_energy_demand_kwh_a)
specific_cooling_energy_demand_kwh_m²a = Number(division_17)
cooling_energy_demand_per_user_kwh_perso = Number(division_18)  # "Cooling Energy Demand per User [kWh/Person a]"
interest = Number(expression_4)
panel_8 = Panel("""interest
area efficiency 
area comfort 
income
expenses 
energy expenses 
effective floor area 
floor area 
users 
construction cost 
specific construction cost 
construction cost per user 
life cycle cost 
specific life cycle cost 
life cycle cost per user 
construction global warming potential 
specific construction global warming potential 
construction global warming potential per user 
life cycle global warming potential 
specific life cycle global warming potential 
life cycle global warming potential per user 
primary energy demand 
specific primary energy demand 
primary energy demand per user 
final energy demand 
specific final energy demand 
final energy demand per user 
heating load 
heating energy demand 
specific heating energy demand 
heating energy demand per user 
cooling load 
cooling energy demand 
specific cooling energy demand 
cooling energy demand per user 
ventilation air flow volume  """)
merge_2 = Merge(
    Data1=interest,
    Data2=area_efficiency_eff_m²_m²,
    Data3=area_comfort_m²_person,
    Data4=income_a_2,
    Data5=expenses_a_2,
    Data6=energy_expenses_a_2,
    Data7=effective_floor_area_m²_11,
    Data8=floor_area_m²_2,
    Data9=users_person_11,
    Data10=construction_cost_4,
    Data11=specific_construction_cost_m²,
    Data12=construction_cost_per_user_person,
    Data13=life_cycle_cost_4,
    Data14=specific_life_cycle_cost_m²,
    Data15=life_cycle_cost_per_user_person,
    Data16=construction_global_warming_potential_kg,
    Data17=specific_construction_global_warming_pot,
    Data18=construction_global_warming_potential_pe,
    Data19=life_cycle_global_warming_potential_kgco,
    Data20=specific_life_cycle_global_warming_poten,
    Data21=life_cycle_global_warming_potential_per,
    Data22=primary_energy_demand_kwh_a_4,
    Data23=specific_primary_energy_demand_kwh_m²a,
    Data24=primary_energy_demand_per_user_kwh_perso,
    Data25=final_energy_demand_kwh_a_4,
    Data26=specific_final_energy_demand_kwh_m²a,
    Data27=final_energy_demand_per_user_kwh_person,
    Data28=heating_load_kw,
    Data29=heating_energy_demand_kwh_a_6,
    Data30=specific_heating_energy_demand_kwh_m²a,
    Data31=heating_energy_demand_per_user_kwh_perso,
    Data32=cooling_load_kw,
    Data33=cooling_energy_demand_kwh_a_4,
    Data34=specific_cooling_energy_demand_kwh_m²a,
    Data35=cooling_energy_demand_per_user_kwh_perso,
    Data36=ventilation_air_flow_volume_m³_s)
dsn_2 = ModelDesign(Design=dn_2)  # -> Design, Valid, Name, Description, Icon, Image, Variant, View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
panel_9 = Panel(merge_2)
trim_3 = TrimTree(Tree=dsn_2.Qualities, Depth=1)
panel_10 = Panel("""%
eff. m²/m²
m²/Person
€/a
€/a
€/a
m²
m²
Person
€
€/m²
€/Person
€
€/m²
€/Person
kgCO2e
kgCO2e/m²
kgCO2e/Person
kgCO2e
kgCO2e/m²
kgCO2e/Person
kWh/a
kWh/m²a
kWh/Person a
kWh/a
kWh/m²a
kWh/Person a
kW
kWh/a
kWh/m²a
kWh/Person a
kW
kWh/a
kWh/m²a
kWh/Person a
m³/s""")
qal_23 = ModelQuality(Name=panel_8, Value=merge_2, Unit=panel_10)  # -> Quality, Valid, Name, Value, Unit, Definition
merge_3 = Merge(Data1=trim_3, Data2=qal_23.Quality)
dsn_3 = ModelDesign(Design=dsn_2.Design, Qualities=merge_3)  # -> Design, Valid, Name, Description, Icon, Image, Variant, View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
dn_3 = ClusterOutput(dsn_3.Design)
interest_2 = ClusterOutput(interest)
area_efficiency_eff_m²_m²_2 = ClusterOutput(area_efficiency_eff_m²_m²)
area_comfort_m²_person_2 = ClusterOutput(area_comfort_m²_person)
income_a_3 = ClusterOutput(income_a_2)
expenses_a_3 = ClusterOutput(expenses_a_2)
energy_expenses_a_3 = ClusterOutput(energy_expenses_a_2)
effective_floor_area_m²_12 = ClusterOutput(effective_floor_area_m²_11)
floor_area_m²_3 = ClusterOutput(floor_area_m²_2)
users_person_12 = ClusterOutput(users_person_11)
construction_cost_5 = ClusterOutput(construction_cost_4)
specific_construction_cost_m²_2 = ClusterOutput(specific_construction_cost_m²)
construction_cost_per_user_person_2 = ClusterOutput(construction_cost_per_user_person)
life_cycle_cost_5 = ClusterOutput(life_cycle_cost_4)
specific_life_cycle_cost_m²_2 = ClusterOutput(specific_life_cycle_cost_m²)
life_cycle_cost_per_user_person_2 = ClusterOutput(life_cycle_cost_per_user_person)
construction_global_warming_potential_kg_2 = ClusterOutput(construction_global_warming_potential_kg)  # "Construction Global Warming Potential [kgCO2e]"
specific_construction_global_warming_pot_2 = ClusterOutput(specific_construction_global_warming_pot)  # "Specific Construction Global Warming Potential [kgCO2e/m²]"
construction_global_warming_potential_pe_2 = ClusterOutput(construction_global_warming_potential_pe)  # "Construction Global Warming Potential per User [kgCO2e/Person]"
life_cycle_global_warming_potential_kgco_2 = ClusterOutput(life_cycle_global_warming_potential_kgco)  # "Life Cycle Global Warming Potential [kgCO2e]"
specific_life_cycle_global_warming_poten_2 = ClusterOutput(specific_life_cycle_global_warming_poten)  # "Specific Life Cycle Global Warming Potential [kgCO2e/m²]"
life_cycle_global_warming_potential_per_2 = ClusterOutput(life_cycle_global_warming_potential_per)  # "Life Cycle Global Warming Potential per User [kgCO2e/Person]"
primary_energy_demand_kwh_a_5 = ClusterOutput(primary_energy_demand_kwh_a_4)
specific_primary_energy_demand_kwh_m²a_2 = ClusterOutput(specific_primary_energy_demand_kwh_m²a)
primary_energy_demand_per_user_kwh_perso_2 = ClusterOutput(primary_energy_demand_per_user_kwh_perso)  # "Primary Energy Demand per User [kWh/Person a]"
final_energy_demand_kwh_a_5 = ClusterOutput(final_energy_demand_kwh_a_4)
specific_final_energy_demand_kwh_m²a_2 = ClusterOutput(specific_final_energy_demand_kwh_m²a)
final_energy_demand_per_user_kwh_person_2 = ClusterOutput(final_energy_demand_per_user_kwh_person)  # "Final Energy Demand per User [kWh/Person a]"
heating_load_kw_2 = ClusterOutput(heating_load_kw)
heating_energy_demand_kwh_a_7 = ClusterOutput(heating_energy_demand_kwh_a_6)
specific_heating_energy_demand_kwh_m²a_2 = ClusterOutput(specific_heating_energy_demand_kwh_m²a)
heating_energy_demand_per_user_kwh_perso_2 = ClusterOutput(heating_energy_demand_per_user_kwh_perso)  # "Heating Energy Demand per User [kWh/Person a]"
cooling_load_kw_2 = ClusterOutput(cooling_load_kw)
cooling_energy_demand_kwh_a_5 = ClusterOutput(cooling_energy_demand_kwh_a_4)
specific_cooling_energy_demand_kwh_m²a_2 = ClusterOutput(specific_cooling_energy_demand_kwh_m²a)
cooling_energy_demand_per_user_kwh_perso_2 = ClusterOutput(cooling_energy_demand_per_user_kwh_perso)  # "Cooling Energy Demand per User [kWh/Person a]"
ventilation_air_flow_volume_m³_s_2 = ClusterOutput(ventilation_air_flow_volume_m³_s)

# ----
# Beispiel
# NullToBranch nur bei unterster Kategorie
panel_11 = Panel("heating energy demand")
panel_12 = Panel(heating_energy_demand_kwh_a_3)
dsn_4 = ModelDesign(Design=dn_2)  # -> Design, Valid, Name, Description, Icon, Image, Variant, View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
trim_4 = TrimTree(Tree=dsn_4.Pieces, Depth=1)
typ_3 = SelectTypeByPiece(ty=ty_2, pc=trim_4)  # -> ty_4, i_2
typ_4 = ModelType(Type=typ_3.ty_4)  # -> Type, Valid, Name, Description, Icon, Image, Variant, Stock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
ventilation_heat_recovery_factor_5 = Number(ventilation_heat_recovery_factor_2)
expression_5 = Expression(x=ventilation_heat_recovery_factor_5, Expression="1-x")
replace_2 = ReplaceItems(Wrap=False)
item_3 = ListItem(Index=0, Wrap=True)

# ----
# explizit definierte Oberkategorie
qal_24 = SumQualities(dn=dn_2, ty=ty_2, na=panel_11)  # -> num_2, ql_2

ql_2 = Quality(typ_4.Qualities)
txt_2 = Text("heating energy demand")

panel_13 = Panel(qal_24.num_2)
null_3 = NullItem(Item=qal_24.num_2)  # -> NullFlags, InvalidFlags, Description
filter_2 = StreamFilter(Gate=null_3.NullFlags, Stream0=qal_24.num_2, Stream1=heating_energy_demand_kwh_a_3)
qal_25 = SelectQuality(ql=ql_2, na="ventilation heat demand")  # -> graft(ql_4)
qal_26 = SelectQuality(ql=ql_2, na="transmission heat demand")  # -> graft(ql_4)
qal_27 = ModelQuality(Quality=qal_26)  # -> Quality, Valid, Name, Value, Unit, Definition
qal_28 = ModelQuality(Quality=qal_25)  # -> Quality, Valid, Name, Value, Unit, Definition
panel_14 = Panel(ql_2)
qal_29 = SelectQuality(ql=ql_2, na=txt_2)  # -> graft(ql_4)
transmission_heat_loss_kwh_a_5 = Number(qal_27.Value)
ventiation_heat_loss_kwh_a_3 = Number(qal_28.Value)
qal_30 = ModelQuality(Quality=qal_29)  # -> Quality, Valid, Name, Value, Unit, Definition
null_4 = NullItem(Item=qal_29)  # -> NullFlags, InvalidFlags, Description
multiplication_20 = Multiplication(A=ventiation_heat_loss_kwh_a_3, B=expression_5)
addition_18 = Addition(A=transmission_heat_loss_kwh_a_5, B=multiplication_20)
nulltobranch_2 = AddNullToEmptyBranch(D=addition_18)  # -> R; inputs D: tree; same code as nulltobranch
nullrep_2 = ReplaceNulls(Items=nulltobranch_2, Replacements="0")  # -> Items, Count
merge_4 = Merge(Data1=qal_30.Value, Data2=nullrep_2.Items)
panel_15 = Panel(merge_4)
item_4 = ListItem(List=merge_4, Index=null_4.NullFlags, Wrap=invert(True))
panel_16 = Panel(nulltobranch_2)
panel_17 = Panel(addition_18)

trim_5 = TrimTree(Tree=item_4, Depth=1)
num_2 = Number(trim_5)

panel_18 = Panel(num_2)

# ==== cluster SumQualities: Sum up the qualities of a type for each piece with this type in a design.
dn = ClusterInput()
ty = ClusterInput()
na = ClusterInput()
dn_2 = Design(dn)
ty_2 = Type(ty)
na_2 = Name(na)
dsn = ModelDesign(Design=dn_2)  # -> Design, Valid, Name, Description, Icon, Image, Variant, View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
typ = ModelType(Type=ty_2)  # -> Type, Valid, Name, Description, Icon, Image, Variant, Stock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
panel = Panel(ty_2)
qal = ModelQuality(Quality=typ.Qualities)  # -> Quality, Valid, Name, Value, Unit, Definition
trim = TrimTree(Tree=dsn.Pieces, Depth=1)
pce = ModelPiece(Piece=trim)  # -> Piece, Valid, Id, Description, TypeName, TypeVariant, Plane, Center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
expression = Expression(x=graft(pce.TypeName), y=typ.Name, Expression="x=y")
expression_2 = Expression(x=na_2, y=qal.Name, Expression="x=y")
expression_3 = Expression(x=graft(pce.TypeVariant), y=typ.Variant, Expression="x=y")
panel_2 = Panel(pce.TypeName)
panel_3 = Panel(typ.Qualities)
cull = CullPattern(List=typ.Qualities, CullPattern=expression_2)
and = GateAnd(A=expression, B=expression_3)
cull_2 = CullPattern(List=ty_2, CullPattern=and)
qal_2 = ModelQuality(Quality=cull)  # -> Quality, Valid, Name, flatten(Value), Unit, Definition
lng = ListLength(List=ty_2)
txt = Text(cull_2)
txt_2 = Text(ty_2)
series = Series(Start=0, Step=1, Count=lng)
expression_4 = Expression(x=txt, y=txt_2, Expression="x=y")
trim_2 = TrimTree(Tree=series, Depth=1)
panel_5 = Panel(qal_2.Quality)
cull_3 = CullPattern(List=trim_2, CullPattern=expression_4)
trim_3 = TrimTree(Tree=cull_3, Depth=1)
item = ListItem(List=qal_2.Value, Index=trim_3, Wrap=True)
clean = CleanTree(RemoveNulls=True, RemoveInvalid=True, RemoveEmpty=False, Tree=item)
ma = MassAddition(Input=clean)  # -> Result, PartialResults
num = Number(ma.Result)
ql = Quality(qal_2.Quality)
num_2 = ClusterOutput(num)
ql_2 = ClusterOutput(ql)

# ==== cluster SelectTypeByPiece: Select the type of a piece.
ty = ClusterInput()
pc = ClusterInput()
pc_2 = Piece(graft(pc))
ty_2 = Type(ty)
pce = ModelPiece(Piece=pc_2)  # -> Piece, Valid, Id, Description, TypeName, TypeVariant, Plane, Center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
typ = SelectType(ty=ty_2, na=pce.TypeName, variant=pce.TypeVariant)  # -> ty_4, i_2
trim = TrimTree(Tree=typ.ty_4, Depth=1)
trim_2 = TrimTree(Tree=typ.i_2, Depth=1)
ty_3 = Type(trim)
i = Integer(trim_2)
ty_4 = ClusterOutput(ty_3)
i_2 = ClusterOutput(i)

# ==== cluster SelectQuality: Select a quality by its name. If no quality matches, null is returned.
ql = ClusterInput()
na = ClusterInput()
na_2 = Name(graft(na))
ql_2 = Quality(ql)
qal = ModelQuality(Quality=ql_2)  # -> Quality, Valid, Name, Value, Unit, Definition
expression = Expression(x=qal.Name, y=na_2, Expression="x=y")
cull = CullPattern(List=qal.Quality, CullPattern=expression)
nulltobranch = AddNullToEmptyBranch(D=cull)  # -> R; inputs D: tree
# ---------- nulltobranch: C# ----------
#region Usings
using System;
using System.Linq;
using System.Collections;
using System.Collections.Generic;
using System.Drawing;

using Rhino;
using Rhino.Geometry;

using Grasshopper;
using Grasshopper.Kernel;
using Grasshopper.Kernel.Data;
using Grasshopper.Kernel.Types;
#endregion

public class Script_Instance : GH_ScriptInstance
{

    private void RunScript(DataTree<object> D, ref object R)
    {
        foreach (GH_Path path in D.Paths)
            if (D.Branch(path).Count == 0)
                D.Add(null, path);

        R = D;
    }
}
# ---------- end nulltobranch ----------
trim = TrimTree(Tree=nulltobranch, Depth=1)
ql_3 = Quality(trim)
ql_4 = ClusterOutput(ql_3)

# ==== cluster SelectType: Select a type with a name and an optional variant. If no variant is provided it will select all variants. If you want to select the default type then use the empty text.
ty = ClusterInput()
na = ClusterInput()
variant = ClusterInput()
na_2 = Name(na)
variant_2 = Variant(variant)
ty_2 = Type(ty)
typ = ModelType(Type=ty_2)  # -> Type, Valid, Name, Description, Icon, Image, Variant, Stock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
expression = Expression(x=typ.Name, y=na_2, Expression="x=y")
cull = CullPattern(List=typ.Type, CullPattern=expression)
typ_2 = ModelType(Type=cull)  # -> Type, Valid, Name, Description, Icon, Image, Variant, Stock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
expression_2 = Expression(x=typ_2.Variant, y=variant_2, Expression="x=y")
txt = Text(ty_2)
cull_2 = CullPattern(List=typ_2.Type, CullPattern=expression_2)
null = NullItem(Item=variant_2)  # -> NullFlags, InvalidFlags, Description
filter = StreamFilter(Gate=null.NullFlags, Stream0=cull_2, Stream1=cull)
txt_2 = Text(filter)
mindex = MemberIndex(Set=txt, Member=txt_2)  # -> Index, Count
trim = TrimTree(Tree=mindex.Index, Depth=1)
ty_3 = Type(filter)
i = Integer(trim)
ty_4 = ClusterOutput(ty_3)
i_2 = ClusterOutput(i)
