# Grasshopper definition opionionated-quality.gh (Grasshopper 1.0.8)
# Copyright: GNU Lesser General Public License Version 3
# plug-ins: semio

qal = StandardQuality({"Area": "semio.area", "Gross Area": "semio.area.gross", "Net Area": "semio.area.gross.net", "Usable Area": "semio.area.gross.net.usable", "Living and Staying Area": "semio.area.gross.net.usable.living-and-staying", "Living Room Area": "semio.area.gross.net.usable.living-and-staying.living-room"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}, selected="Exterior Wall Construction Area": "semio.area.gross.construction.exterior-wall-construction")
qal_2 = StandardQuality({"Area": "semio.area", "Gross Area": "semio.area.gross", "Net Area": "semio.area.gross.net", "Usable Area": "semio.area.gross.net.usable", "Living and Staying Area": "semio.area.gross.net.usable.living-and-staying", "Living Room Area": "semio.area.gross.net.usable.living-and-staying.living-room"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}, selected="Interior Wall Construction Area": "semio.area.gross.construction.interior-wall-construction")
qal_3 = StandardQuality({"Area": "semio.area", "Gross Area": "semio.area.gross", "Net Area": "semio.area.gross.net", "Usable Area": "semio.area.gross.net.usable", "Living and Staying Area": "semio.area.gross.net.usable.living-and-staying", "Living Room Area": "semio.area.gross.net.usable.living-and-staying.living-room"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}, selected="Net Area")
qal_4 = OpinionatedQuality(na=qal, value=Slider(9, range=0..1000), im=False)
qal_5 = OpinionatedQuality(na=qal_3, value=Slider(150, range=0..1000), im=False)
qal_6 = OpinionatedQuality(na=qal_2, value=Slider(9, range=0..1000), im=False)
merge = Merge(Data1=qal_5, Data2=qal_4, Data3=qal_6)
typ = ModelType(Qualities=merge)  # -> Type, Valid, Name, Description, Icon, Image, Variant, Stock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
qal_7 = ModelQuality(Quality=typ.Qualities)  # -> Quality, Valid, Name, Value, Unit, Definition
panel = Panel(qal_7.Unit)
panel_2 = Panel(qal_7.Value)
unt = ConvertUnit(Value=qal_7.Value, FromUnit=qal_7.Unit, ToUnit="ft²")
panel_3 = Panel(unt)

# ==== cluster OpinionatedQuality: Construct an opinionated quality with a standard name.
# Raumnutzungsarten nach DIN 277-2: https://search.bsdd.buildingsmart.org/uri/cafmring/din277-2/2024.0.1
qal = StandardQuality({"Area": "semio.area", "Gross Area": "semio.area.gross", "Net Area": "semio.area.gross.net", "Usable Area": "semio.area.gross.net.usable", "Living and Staying Area": "semio.area.gross.net.usable.living-and-staying", "Living Room Area": "semio.area.gross.net.usable.living-and-staying.living-room"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}, selected="Area")
na = ClusterInput()
im = ClusterInput()
value = ClusterInput()
panel = Panel("""semio.floor-area
semio.floor-area.effective
semio.floor-area.infrastrastructure""")
na_2 = Name(na)
value_2 = Value(value)
im_2 = Boolean(im)
itemindex = ItemIndex(L=panel, I=na_2)  # -> i; inputs L: list
# ---------- itemindex: Python ----------
#Component Information
#--------------------------------------------------------------------------------------------
if ghenv.Component.RunCount<2:
    #General
    #--------------------------------------------------------------------------------------------
    __author__ = "Ueli Saluz"
    __version__ = "2022.11.18"
    
    ghenv.Component.Name = "ItemIndex"
    ghenv.Component.NickName = "ItemIndex"
    ghenv.Component.Description = "A better IdemIndex"
    ghenv.Component.Message = "VER 1.0"
    ghenv.Component.Category = "Set"
    ghenv.Component.SubCategory = "List"
    
     #Inputs
    #--------------------------------------------------------------------------------------------
    inputIndex=0
    
    ghenv.Component.Params.Input[inputIndex].Name = "List"
    ghenv.Component.Params.Input[inputIndex].NickName = "L"
    ghenv.Component.Params.Input[inputIndex].Description = "Input1 is..."
    ghenv.Component.Params.Input[inputIndex].Optional = False
    inputIndex+=1
    
    ghenv.Component.Params.Input[inputIndex].Name = "Item"
    ghenv.Component.Params.Input[inputIndex].NickName = "I"
    ghenv.Component.Params.Input[inputIndex].Description = "Input2 is..."
    ghenv.Component.Params.Input[inputIndex].Optional = False
    inputIndex+=1
    
    #Outputs
    #--------------------------------------------------------------------------------------------
    outputIndex=0
    
    ghenv.Component.Params.Output[outputIndex].Name = "Index"
    ghenv.Component.Params.Output[outputIndex].NickName = "i"
    ghenv.Component.Params.Output[outputIndex].Description = "Output1 is..."
    outputIndex+=1

i = L.index(I)
# ---------- end itemindex ----------
merge = Merge(Data1=graft("m²"), Data2=graft("ft²"))
item = ListItem(List=merge, Index=im_2, Wrap=True)
trim = TrimTree(Tree=item, Depth=1)
panel_2 = Panel("https://identifier.buildingsmart.org/uri/buildingsmart/ifc/4.3/prop/NetFloorArea")
item_2 = ListItem(List=panel_2, Index=itemindex, Wrap=True)
qal_2 = ModelQuality(Name=na_2, Value=value_2, Unit=trim, Definition=item_2)  # -> Quality, Valid, Name, Value, Unit, Definition
ql = Quality(qal_2.Quality)
ql_2 = ClusterOutput(ql)
